# Grasshopper definition 02B_DaylightAutonomi_Revit_XX.gh (Grasshopper 1.0.7)
# Copyright: 2017
# Copyright: 2021-20-24
# Copyright: 2021
# plug-ins: PollinationGH, EleFront, LadybugGrasshopper, MetaHopper, Human, Rhino.Inside for Autodesk Revit

# ----
# Plugins needed: Ladybug Tools: Version 1.4.1
#   Pollination:
#   Rhino.Inside.Revit:
# To update LBT version, press TRUE
lb_falsestarttoggle = LBFalseStartToggle(False)
versioner = LBVersioner(update=lb_falsestarttoggle, version="1.4.1")  # -> out; plug-in component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

# ----
# Define boundary conditions
# Visualize north arrow
weather_file = Panel("DK_DRY_2001-2010.epw")
# 5)
# Choose a weather file
file_path = Panel("G:\4_VVS-afdelingen\06_Faggrupper\05_02 Energi og indeklima\05 Programmer\Vejrdata til BSim og IES\Gældende IES filer")
# Set model rotation
north_rotation_counter_clockwise = Slider(0, range=0..360)
# 6)
boolean_toggle = BooleanToggle(False)
hide_show_object_preview = HideShowObjectPreview(Visible=boolean_toggle, AllObjects_Object=render_curve_to_screen)

button = Button()
# Bake sensor planes from Rooms/Spaces
button_2 = Button()
perimeter_offset = ValueList({"0 mm", "100 mm": "-100 mm", "200 mm": "-200 mm", "300 mm": "-300 mm", "400 mm": "-400 mm", "500 mm": "-500 mm", "600 mm": "-600 mm", "700 mm": "-700 mm", "800 mm": "-800 mm", "900 mm": "-900 mm", "1000 mm": "-1000 mm"}, selected="500 mm")

# ----
# Visualize geometry
# Visualize wireframe
# Visualize opaque materials
# Visualize windows
# Visualize shading
# Visualize grid points
lb_falsestarttoggle_2 = LBFalseStartToggle(False)
hide_show_object_preview_2 = HideShowObjectPreview(Visible=lb_falsestarttoggle_2)
lb_falsestarttoggle_3 = LBFalseStartToggle(False)
hide_show_object_preview_3 = HideShowObjectPreview(Visible=lb_falsestarttoggle_3)
lb_falsestarttoggle_4 = LBFalseStartToggle(False)
hide_show_object_preview_4 = HideShowObjectPreview(Visible=lb_falsestarttoggle_4)
lb_falsestarttoggle_5 = LBFalseStartToggle(False)
hide_show_object_preview_5 = HideShowObjectPreview(
    Visible=lb_falsestarttoggle_5,
    AllObjects_Object=[custom_preview_17, custom_preview_18, custom_preview_19, custom_preview_20])
lb_falsestarttoggle_6 = LBFalseStartToggle(False)
hide_show_object_preview_6 = HideShowObjectPreview(Visible=lb_falsestarttoggle_6, AllObjects_Object=dot_display)

reflectance = ValueList({"0.01", "0.02", "0.03", "0.04", "0.05", "0.06", "0.07", "0.08", "0.09", "0.10"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}, selected="0.50")

reflectance_2 = ValueList({"0.01", "0.02", "0.03", "0.04", "0.05", "0.06", "0.07", "0.08", "0.09", "0.10"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}, selected="0.70")

reflectance_3 = ValueList({"0.01", "0.02", "0.03", "0.04", "0.05", "0.06", "0.07", "0.08", "0.09", "0.10"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}, selected="0.70")
colour_swatch = ColourSwatch(SwatchColor=RGB(120, 99, 99))

reflectance_4 = ValueList({"0.01", "0.02", "0.03", "0.04", "0.05", "0.06", "0.07", "0.08", "0.09", "0.10"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}, selected="0.20")

reflectance_5 = ValueList({"0.01", "0.02", "0.03", "0.04", "0.05", "0.06", "0.07", "0.08", "0.09", "0.10"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}, selected="0.70")
colour_swatch_2 = ColourSwatch(SwatchColor=RGB(120, 80, 80))

reflectance_6 = ValueList({"0.01", "0.02", "0.03", "0.04", "0.05", "0.06", "0.07", "0.08", "0.09", "0.10"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}, selected="0.20")

reflectance_7 = ValueList({"0.01", "0.02", "0.03", "0.04", "0.05", "0.06", "0.07", "0.08", "0.09", "0.10"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}, selected="0.20")

reflectance_8 = ValueList({"0.01", "0.02", "0.03", "0.04", "0.05", "0.06", "0.07", "0.08", "0.09", "0.10"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}, selected="0.20")

reflectance_9 = ValueList({"0.01", "0.02", "0.03", "0.04", "0.05", "0.06", "0.07", "0.08", "0.09", "0.10"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}, selected="0.50")

reflectance_10 = ValueList({"0.01", "0.02", "0.03", "0.04", "0.05", "0.06", "0.07", "0.08", "0.09", "0.10"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}, selected="0.20")

# ---- group: Revit
model = ModelCategoriesPicker({"Abutments": -2006130, "Air Systems": -2001008, "Air Terminals": -2008013, "Analysis Display Style": -2000304, "Analysis Results": -2000303, "Areas": -2003200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}, selected="Floors": -2000032)
rir_get_floors = RIRGetFloors(C=model)  # -> list_a, list_b; disabled

model_2 = ModelCategoriesPicker({"Abutments": -2006130, "Air Systems": -2001008, "Air Terminals": -2008013, "Analysis Display Style": -2000304, "Analysis Results": -2000303, "Areas": -2003200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}, selected="Structural Columns": -2001330)  # disabled
model_3 = ModelCategoriesPicker({"Abutments": -2006130, "Air Systems": -2001008, "Air Terminals": -2008013, "Analysis Display Style": -2000304, "Analysis Results": -2000303, "Areas": -2003200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}, selected="Columns": -2000100)  # disabled
rir_get_geo = RIRGetGeo(C=[model_2, model_3])  # disabled

model_4 = ModelCategoriesPicker({"Abutments": -2006130, "Air Systems": -2001008, "Air Terminals": -2008013, "Analysis Display Style": -2000304, "Analysis Results": -2000303, "Areas": -2003200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}, selected="Roofs": -2000035)  # disabled
rir_get_roof = RIRGetFloors(C=model_4)  # -> list_a, list_b

model_5 = ModelCategoriesPicker({"Abutments": -2006130, "Air Systems": -2001008, "Air Terminals": -2008013, "Analysis Display Style": -2000304, "Analysis Results": -2000303, "Areas": -2003200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}, selected="Stairs": -2000120)  # disabled
rir_get_geo_2 = RIRGetGeo(C=model_5)  # disabled

wall_system_family = WallSystemFamily({"Basic": 0, "Curtain": 1, "Stacked": 2}, selected="Basic")  # disabled
cluster = Cluster_4(wall_system_family=wall_system_family)  # -> internal_walls_2, external_wall_exterior_surface_2

model_6 = ModelCategoriesPicker({"Abutments": -2006130, "Air Systems": -2001008, "Air Terminals": -2008013, "Analysis Display Style": -2000304, "Analysis Results": -2000303, "Areas": -2003200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}, selected="Ceilings": -2000038)  # disabled
rir_get_geo_3 = RIRGetGeo(C=model_6)  # disabled
ceilings = Merge(Data1=rir_get_geo_3, Data2=rir_get_floors.list_a, Data3=rir_get_roof.list_a)

# ----
transmittance = ValueList({"99", "98", "97", "96", "95", "94", "93", "92", "91", "90"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}, selected="64")
colour_swatch_3 = ColourSwatch(SwatchColor=RGBA(0, 238, 255, 100))

transmittance_2 = ValueList({"99", "98", "97", "96", "95", "94", "93", "92", "91", "90"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}, selected="74")
colour_swatch_4 = ColourSwatch(SwatchColor=RGBA(0, 128, 0, 100))

transmittance_3 = ValueList({"99", "98", "97", "96", "95", "94", "93", "92", "91", "90"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}, selected="71")

transmittance_4 = ValueList({"99", "98", "97", "96", "95", "94", "93", "92", "91", "90"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}, selected="77")
colour_swatch_5 = ColourSwatch(SwatchColor=RGBA(60, 255, 0, 100))

transmittance_5 = ValueList({"99", "98", "97", "96", "95", "94", "93", "92", "91", "90"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}, selected="41")

transmittance_6 = ValueList({"99", "98", "97", "96", "95", "94", "93", "92", "91", "90"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}, selected="82")
colour_swatch_6 = ColourSwatch(SwatchColor=RGBA(179, 0, 255, 100))

reflectance_11 = ValueList({"0.01", "0.02", "0.03", "0.04", "0.05", "0.06", "0.07", "0.08", "0.09", "0.10"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}, selected="0.20")

reflectance_12 = ValueList({"0.01", "0.02", "0.03", "0.04", "0.05", "0.06", "0.07", "0.08", "0.09", "0.10"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}, selected="0.10")

reflectance_13 = ValueList({"0.01", "0.02", "0.03", "0.04", "0.05", "0.06", "0.07", "0.08", "0.09", "0.10"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}, selected="0.20")
colour_swatch_7 = ColourSwatch(SwatchColor=RGB(0, 0, 0))

reflectance_14 = ValueList({"0.01", "0.02", "0.03", "0.04", "0.05", "0.06", "0.07", "0.08", "0.09", "0.10"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}, selected="0.01")
colour_swatch_8 = ColourSwatch(SwatchColor=RGB(239, 120, 250))

# ---- group: Revit
model_7 = ModelCategoriesPicker({"Abutments": -2006130, "Air Systems": -2001008, "Air Terminals": -2008013, "Analysis Display Style": -2000304, "Analysis Results": -2000303, "Areas": -2003200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}, selected="Topography": -2001340)  # disabled
rir_get_terrain = RIRGetTerrain(C=model_7)

model_8 = ModelCategoriesPicker({"Abutments": -2006130, "Air Systems": -2001008, "Air Terminals": -2008013, "Analysis Display Style": -2000304, "Analysis Results": -2000303, "Areas": -2003200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}, selected="Generic Models": -2000151)  # disabled
rir_get_balconies = RIRGetBalconies(C=model_8)

# ----
# INSPECT NORMALS
brep = Brep()
debrep = DeconstructBrep(Brep=brep)  # -> flatten(Faces), Edges, Vertices
evalsrf = EvaluateSurface(Surface=reparameterize(debrep.Faces), Point="{0.5,0.5,0}")  # -> Point, Normal, UDirection, VDirection, Frame
panel = Panel(evalsrf.Normal)
amp = Amplitude(Vector=evalsrf.Normal, Amplitude=Slider(1000, range=0..1000))
vdisex = VectorDisplayEx(Point=evalsrf.Point, Vector=amp, Colour=RGB(0, 0, 0), Width=2)

point = Point()  # disabled
point_2 = Point()  # disabled

# ----
# Select weather file
concatenate = Concatenate(FragmentA=file_path, FragmentA_2="\", WeatherFile=weather_file)
file_path_2 = FilePath(concatenate)
wea = HBWeaFromEPW(epw_file=file_path_2)  # -> wea; plug-in component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

panel_2 = Panel("""brep
surface
extrusion
mesh""")
dpipeline = DynamicGeometryPipeline(
    LayerFilter=graft("3_Analysis::Sensor"),
    TypeFilter=panel_2,
    NameFilter="*",
    GroupByLayer=False,
    GroupByType=False,
    IncludeHidden=True,
    IncludeLocked=True,
    enableFullPath=True,
    listenToAttributes=True)
clean = CleanTree(RemoveNulls=True, RemoveInvalid=True, RemoveEmpty=True, Tree=dpipeline)
sensorplane = Geometry(clean)

sensorplanes_manually_drawn = Brep(sensorplane)

# ----
# Get Room floors
model_9 = ModelCategoriesPicker({"Abutments": -2006130, "Air Systems": -2001008, "Air Terminals": -2008013, "Analysis Display Style": -2000304, "Analysis Results": -2000303, "Areas": -2003200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}, selected="Rooms": -2000160)  # disabled
catfltr = CategoryFilter(Categories=model_9, Inverted=False)
query_elements = QueryElements(Filter=catfltr, Limit="100000000")  # -> Elements, Count
element_geometry = ElementGeometry(Elements=query_elements.Elements)
debrep_2 = DeconstructBrep(Brep=element_geometry)  # -> Faces, Edges, Vertices
evalsrf_2 = EvaluateSurface(Surface=reparameterize(debrep_2.Faces), Point="{0.5,0.5,0}")  # -> Point, Normal, UDirection, VDirection, Frame
expression = Expression(x=evalsrf_2.Normal, Expression="if(x={0,0,-1},True,False)")
panel_3 = Panel(evalsrf_2.Normal)
cull_pattern = CullPattern(List=debrep_2.Faces, CullPattern=expression)

text = Text(query_elements.Elements)
text_split = TextSplit(Text=text, Separators=":")
value_list = ValueList({"Default", "AFRY annotation style"}, selected="Default")
area = Area(Geometry=cull_pattern)  # -> Area, Centroid
list_item = ListItem(List=text_split, Index="1", Wrap=True)

# ----
# Remove small areas < 5m2
panel_4 = Panel("2236mm")
docunits = ConvertToDocumentUnits(ValueString=panel_4)
multiplication = Multiplication(A=docunits, B=docunits)
area_2 = Area(Geometry=cull_pattern)  # -> Area, Centroid
larger = LargerThan(FirstNumber=area_2.Area, SecondNumber=multiplication)  # -> LargerThan, OrEqualTo
cull = CullPattern(List=cull_pattern, CullPattern=larger.LargerThan)

sensorplanes_from_rooms_spaces = Brep(cull)
bake_objects = BakeObjects(Geometry=cull, Bake=button_2)
define_text_object = DefineTextObject(Text=list_item, Plane=area.Centroid, DimensionStyle=value_list, OutputType="Text")
scale = Scale(Geometry=define_text_object, Center=Point(0, 0, 0), Factor=Slider(1000, range=0..1000))  # -> Geometry, Transform
panel_5 = Panel(scale.Geometry)

# ----
# Create calculation schedule
daylithours_dk_dry_2001_2010 = Data([0, 0, 0, 0, 0, 0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])
schedule = Schedule(values=daylithours_dk_dry_2001_2010)

point_3 = Point()  # disabled
point_4 = Point()  # disabled

# ----
# Visualize north arrow
radians = Radians(Degrees=north_rotation_counter_clockwise)
north_arrow = Curve([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])
rotate = Rotate(Geometry=north_arrow, Angle=radians, Plane=PlaneXY(0, 0, 0))  # -> Geometry, Transform
pt = ConstructPoint(
    XCoordinate=Slider(1, range=1..30, expression="x*50"),
    YCoordinate=Slider(4, range=4..50, expression="x*20"),
    ZCoordinate=0)
render_curve_to_screen = RenderCurveToScreen(
    Curve=rotate.Geometry,
    Location=pt,
    ScaleFactor=Slider(0.1, range=0..1),
    Color=ColourSwatch(SwatchColor=RGB(13, 13, 13)),
    Thickness=1,
    Depth=0.95,
    Fixed=True,
    m_scWithvp=False)

project_parameter = Panel("DaylightResults")
stream_filter = StreamFilter(Gate=Button(), Stream1=project_parameter)
panel_6 = Panel("Generic Models")  # disabled
query_categories = QueryCategories(Type=1, Name=panel_6, IsSubcategory=False)  # disabled

# ----
# Define project name
file_path_3 = Panel("G:\4_VVS-afdelingen\06_Faggrupper\05_02 Energi og indeklima\05 Programmer\Ladybug Tools\EksempelFil")
# 1)
project_name = Panel("RIRtest_SampleHouse")

concatenate_2 = Concatenate(FragmentA=file_path_3, FragmentA_2="\", FragmentB="RADfolder")
panel_7 = Panel(concatenate_2)

# ----
# Run simulation in cloud
list_jobs = ListJobs(Project="labrosse/AFRY_tutorial_project", NumberOfStudies=10)  # -> Names, Descriptions, Recipes, Jobs
simulation_log = Panel("Total model import")
# 8)
simulation_version = ValueList({"v1", "v2", "v3", "v4", "v5", "v6", "v7", "v8", "v9", "v10", "v11", "v12", "v13", "v14", "v15", "v16", "v17", "v18", "v19", "v20", "v21", "v22", "v23", "v24", "v25", "v26", "v27", "v28", "v29", "v30"}, selected="v4")
project_names = Panel(list_jobs.Names)
# Apertures/Glazing
# Deconstruct Windows
# Split Windows based on Normal
# Split Curtain Panels based on Normal
# Get Glazed Elements from Curtain Panels
# Split Curtain Panels based on Normal
# Split Curtain Doors based on Normal
# Split Curtain Double Doors based on Normal
# Split Skylight based on Normal
description = Panel(list_jobs.Descriptions)

concatenate_3 = Concatenate(FragmentA=project_name, FragmentA_2="_", FragmentB=simulation_version)

# ----
# Import geometry from Rhino to Grasshopper
# 3)
# Revit import
# Rhino import
lb_falsestarttoggle_7 = LBFalseStartToggle(False)
# 4)
lb_falsestarttoggle_8 = LBFalseStartToggle(False)
enable_disable_object = EnableDisableObject(
    Enabled=lb_falsestarttoggle_7,
    AllObjects_Object=[model_7, model_6, model_10, model_9, wall_system_family, model_3, model_5, model_11, category_filter, parameter_name, model_12, category_filter_2, frames, model_8, model_13, category_filter_3])
enable_disable_object_2 = EnableDisableObject(
    Enabled=lb_falsestarttoggle_8,
    AllObjects_Object=[import_apertures_2, import_apertures_6, import_apertures, import_apertures_5, import_apertures_4, import_apertures_3, cluster_15, cluster_19, cluster_17, cluster_13, cluster_11, cluster_9, cluster_7, cluster_5, cluster_3, cluster_21, cluster_33, cluster_31, cluster_29, cluster_35])

# ----
# Create layers in Rhino
lb_falsestarttoggle_9 = LBFalseStartToggle(False)

# ----
# Setup simulation
# Define simulation parameters
# Select Pollination recipe
# OBS!
# Vælg altid nyeste version af din recipe.
# For at minimere storage use på skyen bør du
# 1. Vælg den rette recipe (fx. Annual daylight)
# 2. Højreklik på "Setup Run" komponentet
# 3. Tryk på "Get recipe by name"
# 4. Fjern "-viz" bagerst i navnet
radiance_parameters = ValueList({"Min": "-ab 1 -ad 32 -lw 0.1", "Low": "-ab 2 -ad 512 -lw 2e-05", "Medium": "-ab 4 -ad 1024 -lw 2e-05", "High": "-ab 7 -ad 4096 -lw 2e-05", "Max": "-ab 10 -ad 4096 -lw 2e-05"}, selected="Low")
weather_file_2 = Data(wea)
north_offset = Data(north_rotation_counter_clockwise)
rad_parameters = Data(radiance_parameters)
schedule_2 = Data(schedule)
radiance_parameters_2 = Panel(radiance_parameters)

# ----
# Create daylight model
# Create sensor grids
# Create honeybee model
sensorplanes_handpicked = Brep([<brep referenced from the Rhino model> x4])
grid_density = ValueList({"50 mm": "50", "100 mm": "100", "150 mm": "150", "200 mm": "200", "250 mm": "250", "300 mm": "300", "350 mm": "350", "400 mm": "400", "450 mm": "450", "500 mm": "500", "550 mm": "550", "600 mm": "600", "650 mm": "650", "700 mm": "700", "750 mm": "750", "800 mm": "800", "850 mm": "850", "900 mm": "900", "950 mm": "950", "1000 mm": "1000"}, selected="500 mm")
lb_falsestarttoggle_10 = LBFalseStartToggle(False)
# 7)
lb_falsestarttoggle_11 = LBFalseStartToggle(False)
enable_disable_object_3 = EnableDisableObject(Enabled=lb_falsestarttoggle_10, AllObjects_Object=genpts)
sensor_planes_included_in_model = Data(sensorplanes_from_rooms_spaces)
enable_disable_object_4 = EnableDisableObject(Enabled=lb_falsestarttoggle_11, AllObjects_Object=model_14)

createfolder = CSharpScript(path=concatenate_2, create=lb_falsestarttoggle_11)  # -> out, A; inputs path: String, create: Boolean
# ---------- createfolder: C# ----------
 
    
    if (create)
    {    
      if(!System.IO.Directory.Exists(path))
        System.IO.Directory.CreateDirectory(path);
    }
# ---------- end createfolder ----------

# ----
# INPUT PARAMETRE
# 2b)
# Modify RAD materials
# Solids
panel_8 = Panel("0_Solids::")
revit_geometry = Brep(ceilings)
revit_geometry_2 = Brep(rir_get_roof.list_b)
revit_geometry_3 = Brep(rir_get_geo)
revit_geometry_4 = Brep(rir_get_floors.list_b)
revit_geometry_5 = Brep(cluster.external_wall_exterior_surface_2)
revit_geometry_6 = Brep(rir_get_geo_2)
revit_geometry_7 = Brep(cluster.internal_walls_2)
brep_2 = Brep(revit_geometry_6)
brep_3 = Brep(revit_geometry_5)
brep_4 = Brep(revit_geometry)
brep_5 = Brep(revit_geometry_4)
brep_6 = Brep(revit_geometry_2)
brep_7 = Brep(revit_geometry_3)
brep_8 = Brep(revit_geometry_7)
layer_colours = Merge(
    Data1=ColourSwatch(SwatchColor=RGB(240, 230, 228)),
    Data2=ColourSwatch(SwatchColor=RGB(255, 173, 245)),
    Data3=ColourSwatch(SwatchColor=RGB(235, 45, 252)),
    Data4=colour_swatch,
    Data5=ColourSwatch(SwatchColor=RGB(255, 255, 255)),
    Data6=colour_swatch_2,
    Data7=ColourSwatch(SwatchColor=RGB(153, 83, 245)),
    Data8=ColourSwatch(SwatchColor=RGB(252, 45, 45)),
    Data9=ColourSwatch(SwatchColor=RGB(156, 156, 156)),
    Data10=ColourSwatch(SwatchColor=RGB(250, 141, 7)))

# ---- group: Rhino
cluster_2 = Cluster_2(A=panel_8, layer="Column_Int", reflectance=reflectance)  # -> rad_name_2, rhino_layer_name_2
cluster_3 = Cluster_3(lay=cluster_2.rhino_layer_name_2)  # disabled

cluster_4 = Cluster_2(A=panel_8, layer="Door", reflectance=reflectance_3)  # -> rad_name_2, rhino_layer_name_2
cluster_5 = Cluster_3(lay=cluster_4.rhino_layer_name_2)  # disabled

cluster_6 = Cluster_2(A=panel_8, layer="Floor", reflectance=reflectance_4)  # -> rad_name_2, rhino_layer_name_2
cluster_7 = Cluster_3(lay=cluster_6.rhino_layer_name_2)  # disabled

cluster_8 = Cluster_2(A=panel_8, layer="Frames", reflectance=reflectance_5)  # -> rad_name_2, rhino_layer_name_2
cluster_9 = Cluster_3(lay=cluster_8.rhino_layer_name_2)  # disabled

cluster_10 = Cluster_2(A=panel_8, layer="Roof", reflectance=reflectance_6)  # -> rad_name_2, rhino_layer_name_2
cluster_11 = Cluster_3(lay=cluster_10.rhino_layer_name_2)  # disabled

cluster_12 = Cluster_2(A=panel_8, layer="Stairs_Int", reflectance=reflectance_8)  # -> rad_name_2, rhino_layer_name_2
cluster_13 = Cluster_3(lay=cluster_12.rhino_layer_name_2)  # disabled

cluster_14 = Cluster_2(A=panel_8, layer="Wall_Ext", reflectance=reflectance_10)  # -> rad_name_2, rhino_layer_name_2
cluster_15 = Cluster_3(lay=cluster_14.rhino_layer_name_2)  # disabled

cluster_16 = Cluster_2(A=panel_8, layer="Column_Ext", reflectance=reflectance_7)  # -> rad_name_2, rhino_layer_name_2
cluster_17 = Cluster_3(lay=cluster_16.rhino_layer_name_2)  # disabled

cluster_18 = Cluster_2(A=panel_8, layer="Wall_Int", reflectance=reflectance_9)  # -> rad_name_2, rhino_layer_name_2
cluster_19 = Cluster_3(lay=cluster_18.rhino_layer_name_2)  # disabled

cluster_20 = Cluster_2(A=panel_8, layer="Ceiling", reflectance=reflectance_2)  # -> rad_name_2, rhino_layer_name_2
cluster_21 = Cluster_3(lay=cluster_20.rhino_layer_name_2)  # disabled

# ---- group: Revit
model_10 = ModelCategoriesPicker({"Abutments": -2006130, "Air Systems": -2001008, "Air Terminals": -2008013, "Analysis Display Style": -2000304, "Analysis Results": -2000303, "Areas": -2003200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}, selected="Curtain Wall Mullions": -2000171)  # disabled

# ----
rhino_geometry = Brep(cluster_7)
rhino_geometry_2 = Brep(cluster_9)
rhino_geometry_3 = Brep(cluster_11)
rhino_geometry_4 = Brep(cluster_21)
rhino_geometry_5 = Brep(cluster_3)
rhino_geometry_6 = Brep(cluster_13)
rhino_geometry_7 = Brep(cluster_19)
rhino_geometry_8 = Brep(cluster_15)
opaquemod = HBOpaqueModifier(name=cluster_20.rad_name_2, reflect=reflectance_2)  # -> modifier; plug-in component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
opaquemod_2 = HBOpaqueModifier(name=cluster_2.rad_name_2, reflect=reflectance)  # -> modifier; plug-in component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
opaquemod_3 = HBOpaqueModifier(name=cluster_16.rad_name_2, reflect=reflectance_7)  # -> modifier; plug-in component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
opaquemod_4 = HBOpaqueModifier(name=cluster_4.rad_name_2, reflect=reflectance_3)  # -> modifier; plug-in component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
opaquemod_5 = HBOpaqueModifier(name=cluster_6.rad_name_2, reflect=reflectance_4)  # -> modifier; plug-in component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
opaquemod_6 = HBOpaqueModifier(name=cluster_8.rad_name_2, reflect=reflectance_5)  # -> modifier; plug-in component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
opaquemod_7 = HBOpaqueModifier(name=cluster_10.rad_name_2, reflect=reflectance_6)  # -> modifier; plug-in component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
opaquemod_8 = HBOpaqueModifier(name=cluster_12.rad_name_2, reflect=reflectance_8)  # -> modifier; plug-in component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
opaquemod_9 = HBOpaqueModifier(name=cluster_18.rad_name_2, reflect=reflectance_9)  # -> modifier; plug-in component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
opaquemod_10 = HBOpaqueModifier(name=cluster_14.rad_name_2, reflect=reflectance_10)  # -> modifier; plug-in component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
face = HBFace(geo=brep_7, name=cluster_2.rad_name_2, rad_mod=opaquemod_2)  # -> out, faces; plug-in component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
face_2 = HBFace(geo=brep_4, name=cluster_20.rad_name_2, rad_mod=opaquemod)  # -> out, faces; plug-in component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
face_3 = HBFace(geo=cluster_17, name=cluster_16.rad_name_2, rad_mod=opaquemod_3)  # -> out, faces; plug-in component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
face_4 = HBFace(geo=cluster_5, name=cluster_4.rad_name_2, rad_mod=opaquemod_4)  # -> out, faces; plug-in component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
face_5 = HBFace(geo=brep_5, name=cluster_6.rad_name_2, rad_mod=opaquemod_5)  # -> out, faces; plug-in component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
face_6 = HBFace(geo=brep_6, name=cluster_10.rad_name_2, rad_mod=opaquemod_7)  # -> out, faces; plug-in component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
face_7 = HBFace(geo=brep_2, name=cluster_12.rad_name_2, rad_mod=opaquemod_8)  # -> out, faces; plug-in component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
face_8 = HBFace(geo=brep_8, name=cluster_18.rad_name_2, rad_mod=opaquemod_9)  # -> out, faces; plug-in component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
face_9 = HBFace(geo=brep_3, name=cluster_14.rad_name_2, rad_mod=opaquemod_10)  # -> out, faces; plug-in component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
vizall = HBVisualizeAll(hb_objs=flatten(face_5.faces))  # -> geo; plug-in component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
vizall_2 = HBVisualizeAll(hb_objs=flatten(face_8.faces))  # -> geo; plug-in component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
vizall_3 = HBVisualizeAll(hb_objs=flatten(face_9.faces))  # -> geo; plug-in component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
vizall_4 = HBVisualizeAll(hb_objs=flatten(face_3.faces))  # -> geo; plug-in component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
vizall_5 = HBVisualizeAll(hb_objs=flatten(face_6.faces))  # -> geo; plug-in component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
vizall_6 = HBVisualizeAll(hb_objs=flatten(face_7.faces))  # -> geo; plug-in component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
vizall_7 = HBVisualizeAll(hb_objs=flatten(face_4.faces))  # -> geo; plug-in component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
vizall_8 = HBVisualizeAll(hb_objs=flatten(face.faces))  # -> geo; plug-in component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
vizall_9 = HBVisualizeAll(hb_objs=flatten(face_2.faces))  # -> geo; plug-in component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
custom_preview = CustomPreview(Geometry=vizall, Material=ColourSwatch(SwatchColor=RGB(88, 89, 89)))
custom_preview_2 = CustomPreview(Geometry=vizall_2, Material=ColourSwatch(SwatchColor=RGB(148, 148, 148)))
custom_preview_3 = CustomPreview(Geometry=vizall_3, Material=ColourSwatch(SwatchColor=RGB(255, 255, 255)))
custom_preview_4 = CustomPreview(Geometry=vizall_4, Material=ColourSwatch(SwatchColor=RGB(168, 168, 168)))
custom_preview_5 = CustomPreview(Geometry=vizall_5, Material=ColourSwatch(SwatchColor=RGB(12, 12, 13)))
custom_preview_6 = CustomPreview(Geometry=vizall_6, Material=ColourSwatch(SwatchColor=RGB(168, 168, 168)))
custom_preview_7 = CustomPreview(Geometry=vizall_7, Material=colour_swatch)
custom_preview_8 = CustomPreview(Geometry=vizall_8, Material=ColourSwatch(SwatchColor=RGB(109, 110, 110)))
custom_preview_9 = CustomPreview(Geometry=vizall_9, Material=ColourSwatch(SwatchColor=RGB(109, 110, 110)))
layer_names = Merge(
    Data1=cluster_20.rhino_layer_name_2,
    Data2=cluster_2.rhino_layer_name_2,
    Data3=cluster_16.rhino_layer_name_2,
    Data4=cluster_4.rhino_layer_name_2,
    Data5=cluster_6.rhino_layer_name_2,
    Data6=cluster_8.rhino_layer_name_2,
    Data7=cluster_10.rhino_layer_name_2,
    Data8=cluster_12.rhino_layer_name_2,
    Data9=cluster_18.rhino_layer_name_2,
    Data10=cluster_14.rhino_layer_name_2)

# ----
# 2a)
_0_solids = Panel(layer_names)

# ----
# Apertures/Glazing
model_11 = ModelCategoriesPicker({"Abutments": -2006130, "Air Systems": -2001008, "Air Terminals": -2008013, "Analysis Display Style": -2000304, "Analysis Results": -2000303, "Areas": -2003200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}, selected="Windows": -2000014)  # disabled
model_12 = ModelCategoriesPicker({"Abutments": -2006130, "Air Systems": -2001008, "Air Terminals": -2008013, "Analysis Display Style": -2000304, "Analysis Results": -2000303, "Areas": -2003200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}, selected="Curtain Panels": -2000170)  # disabled
model_13 = ModelCategoriesPicker({"Abutments": -2006130, "Air Systems": -2001008, "Air Terminals": -2008013, "Analysis Display Style": -2000304, "Analysis Results": -2000303, "Areas": -2003200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}, selected="Doors": -2000023)  # disabled
# Glazings
parameter_name = Panel("LT")  # disabled
category_filter = CategoryFilter(Categories=model_11, Inverted=False)  # disabled
category_filter_2 = CategoryFilter(Categories=model_12, Inverted=False)  # disabled
category_filter_3 = CategoryFilter(Categories=model_13, Inverted=False)  # disabled
colour_swatch_9 = ColourSwatch(SwatchColor=RGB(0, 128, 0))
colour_swatch_10 = ColourSwatch(SwatchColor=RGB(0, 238, 255))

# ---- group: Rhino
cluster_22 = Cluster(A="1_Glazings::", layer="Glass_Int", transmittance=transmittance_6, colour_of_layer_in_rhino=colour_swatch_6)  # -> rad_name_2, result, layer_name_2, colour_of_layer_in_rhino_3
import_apertures = ImportApertures(lay=cluster_22.layer_name_2)  # disabled

# ---- group: Revit
windows = Text(category_filter)
curtain_panels = Text(category_filter_2)
doors = Text(category_filter_3)
rir_get_window = RIRGetWindow(parameter=parameter_name, value=transmittance_3, windows=windows, curtain_panels=curtain_panels, doors=doors)  # -> frames_mesh_2, result

# ---- group: Rhino
cluster_23 = Cluster(
    A="1_Glazings::",
    layer="OvenlysKuppel",
    transmittance=transmittance_5,
    colour_of_layer_in_rhino=ColourSwatch(SwatchColor=RGBA(0, 115, 255, 100)))  # -> rad_name_2, result, layer_name_2, colour_of_layer_in_rhino_3
import_apertures_2 = ImportApertures(lay=cluster_23.layer_name_2)  # disabled

cluster_24 = Cluster(A="1_Glazings::", layer="Glass", transmittance=transmittance, colour_of_layer_in_rhino=colour_swatch_3)  # -> rad_name_2, result, layer_name_2, colour_of_layer_in_rhino_3
import_apertures_3 = ImportApertures(lay=cluster_24.layer_name_2)  # disabled

cluster_25 = Cluster(A="1_Glazings::", layer="Glass", transmittance=transmittance_2, colour_of_layer_in_rhino=colour_swatch_4)  # -> rad_name_2, result, layer_name_2, colour_of_layer_in_rhino_3
import_apertures_4 = ImportApertures(lay=cluster_25.layer_name_2)  # disabled

cluster_26 = Cluster(A="1_Glazings::", layer="Glass", transmittance=transmittance_4, colour_of_layer_in_rhino=colour_swatch_5)  # -> rad_name_2, result, layer_name_2, colour_of_layer_in_rhino_3
import_apertures_5 = ImportApertures(lay=cluster_26.layer_name_2)  # disabled

cluster_27 = Cluster(
    A="1_Glazings::",
    layer="OvenlysFlad",
    transmittance=transmittance_3,
    colour_of_layer_in_rhino=ColourSwatch(SwatchColor=RGBA(0, 115, 255, 100)))  # -> rad_name_2, result, layer_name_2, colour_of_layer_in_rhino_3
import_apertures_6 = ImportApertures(lay=cluster_27.layer_name_2)  # disabled

# ---- group: Revit
windows_2 = Text(category_filter)
curtain_panels_2 = Text(category_filter_2)
doors_2 = Text(category_filter_3)
rir_get_window_2 = RIRGetWindow(parameter=parameter_name, value=transmittance_5, windows=windows_2, curtain_panels=curtain_panels_2, doors=doors_2)  # -> frames_mesh_2, result

windows_3 = Text(category_filter)
curtain_panels_3 = Text(category_filter_2)
doors_3 = Text(category_filter_3)
rir_get_window_3 = RIRGetWindow(parameter=parameter_name, value=transmittance_2, windows=windows_3, curtain_panels=curtain_panels_3, doors=doors_3)  # -> frames_mesh_2, result

windows_4 = Text(category_filter)
curtain_panels_4 = Text(category_filter_2)
doors_4 = Text(category_filter_3)
rir_get_window_4 = RIRGetWindow(parameter=parameter_name, value=transmittance_4, windows=windows_4, curtain_panels=curtain_panels_4, doors=doors_4)  # -> frames_mesh_2, result

windows_5 = Text(category_filter)
curtain_panels_5 = Text(category_filter_2)
doors_5 = Text(category_filter_3)
rir_get_window_5 = RIRGetWindow(parameter=parameter_name, value=transmittance_6, windows=windows_5, curtain_panels=curtain_panels_5, doors=doors_5)  # -> frames_mesh_2, result

windows_6 = Text(category_filter)
curtain_panels_6 = Text(category_filter_2)
doors_6 = Text(category_filter_3)
rir_get_window_6 = RIRGetWindow(parameter=parameter_name, value=transmittance, windows=windows_6, curtain_panels=curtain_panels_6, doors=doors_6)  # -> frames_mesh_2, result

# ----
rhino_geometry_9 = Brep(import_apertures_4)
rhino_geometry_10 = Brep(import_apertures_3)
rhino_geometry_11 = Brep(import_apertures_5)
rhino_geometry_12 = Brep(import_apertures_2)
revit_geometry_8 = Brep(rir_get_window_6.result)
revit_geometry_9 = Brep(rir_get_window_3.result)
rhino_geometry_13 = Brep(import_apertures)
rhino_geometry_14 = Brep(import_apertures_6)
revit_geometry_10 = Brep(rir_get_window_4.result)
revit_geometry_11 = Brep(rir_get_window_2.result)
revit_geometry_12 = Brep(rir_get_window_5.result)
revit_geometry_13 = Brep(rir_get_window.result)
brep_9 = Brep(revit_geometry_8)
brep_10 = Brep(revit_geometry_9)
brep_11 = Brep(revit_geometry_10)
brep_12 = Brep(revit_geometry_11)
brep_13 = Brep(revit_geometry_12)
brep_14 = Brep(revit_geometry_13)
glassmod = HBGlassModifier(name=cluster_22.rad_name_2, trans=cluster_22.result)  # -> modifier; plug-in component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
glassmod_2 = HBGlassModifier(name=cluster_23.rad_name_2, trans=cluster_23.result)  # -> modifier; plug-in component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
glassmod_3 = HBGlassModifier(name=cluster_24.rad_name_2, trans=cluster_24.result)  # -> modifier; plug-in component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
glassmod_4 = HBGlassModifier(name=cluster_25.rad_name_2, trans=cluster_25.result)  # -> modifier; plug-in component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
glassmod_5 = HBGlassModifier(name=cluster_26.rad_name_2, trans=cluster_26.result)  # -> modifier; plug-in component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
glassmod_6 = HBGlassModifier(name=cluster_27.rad_name_2, trans=cluster_27.result)  # -> modifier; plug-in component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
aperture = HBAperture(geo=brep_9, name=cluster_24.rad_name_2, rad_mod=glassmod_3)  # -> out, apertures; plug-in component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
aperture_2 = HBAperture(geo=brep_10, name=cluster_25.rad_name_2, rad_mod=glassmod_4)  # -> out, apertures; plug-in component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
aperture_3 = HBAperture(geo=brep_14, name=cluster_27.rad_name_2, rad_mod=glassmod_6)  # -> out, apertures; plug-in component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
aperture_4 = HBAperture(geo=brep_12, name=cluster_23.rad_name_2, rad_mod=glassmod_2)  # -> out, apertures; plug-in component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
aperture_5 = HBAperture(geo=brep_11, name=cluster_26.rad_name_2, rad_mod=glassmod_5)  # -> out, apertures; plug-in component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
aperture_6 = HBAperture(geo=brep_13, name=cluster_22.rad_name_2, rad_mod=glassmod)  # -> out, apertures; plug-in component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
vizall_10 = HBVisualizeAll(hb_objs=flatten(aperture.apertures))  # -> geo; plug-in component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
vizall_11 = HBVisualizeAll(hb_objs=flatten(aperture_2.apertures))  # -> geo; plug-in component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
vizall_12 = HBVisualizeAll(hb_objs=flatten(aperture_3.apertures))  # -> geo; plug-in component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
vizall_13 = HBVisualizeAll(hb_objs=flatten(aperture_4.apertures))  # -> geo; plug-in component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
vizall_14 = HBVisualizeAll(hb_objs=flatten(aperture_5.apertures))  # -> geo; plug-in component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
vizall_15 = HBVisualizeAll(hb_objs=flatten(aperture_6.apertures))  # -> geo; plug-in component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
custom_preview_10 = CustomPreview(Geometry=vizall_10, Material=colour_swatch_3)
custom_preview_11 = CustomPreview(Geometry=vizall_11, Material=colour_swatch_4)
custom_preview_12 = CustomPreview(Geometry=vizall_12, Material=ColourSwatch(SwatchColor=RGB(0, 115, 255)))
custom_preview_13 = CustomPreview(Geometry=vizall_13, Material=ColourSwatch(SwatchColor=RGB(0, 115, 255)))
custom_preview_14 = CustomPreview(Geometry=vizall_14, Material=colour_swatch_5)
custom_preview_15 = CustomPreview(Geometry=vizall_15, Material=colour_swatch_6)
layer_names_2 = Merge(
    Data1=cluster_24.layer_name_2,
    Data2=cluster_25.layer_name_2,
    Data3=cluster_26.layer_name_2,
    Data4=cluster_22.layer_name_2,
    Data5=cluster_27.layer_name_2,
    Data6=cluster_23.layer_name_2)
layer_colours_2 = Merge(
    Data1=cluster_24.colour_of_layer_in_rhino_3,
    Data2=cluster_25.colour_of_layer_in_rhino_3,
    Data3=cluster_26.colour_of_layer_in_rhino_3,
    Data4=cluster_22.colour_of_layer_in_rhino_3,
    Data5=cluster_27.colour_of_layer_in_rhino_3,
    Data6=cluster_23.colour_of_layer_in_rhino_3)
apertures = Merge(
    Data1=aperture_3.apertures,
    Data2=aperture.apertures,
    Data3=aperture_2.apertures,
    Data4=aperture_5.apertures,
    Data5=aperture_6.apertures,
    Data6=aperture_4.apertures)
frames = Merge(
    Data1=rir_get_window_6.frames_mesh_2,
    Data2=rir_get_window_3.frames_mesh_2,
    Data3=rir_get_window_4.frames_mesh_2,
    Data4=rir_get_window_5.frames_mesh_2,
    Data5=rir_get_window.frames_mesh_2,
    Data6=rir_get_window_2.frames_mesh_2)  # disabled
data = Data(apertures)
clean_2 = CleanTree(RemoveNulls=True, RemoveInvalid=True, RemoveEmpty=True, Tree=data)
list_length = ListLength(List=flatten(clean_2))

# ---- group: Revit (continued)
rir_get_frames = RIRGetFrames(C=model_10, mesh=frames)  # -> G, mesh_3

# ----
revit_geometry_14 = Geometry([rir_get_frames.G, rir_get_frames.mesh_3])
brep_15 = Brep(revit_geometry_14)
face_10 = HBFace(geo=brep_15, name=cluster_8.rad_name_2, rad_mod=opaquemod_6)  # -> out, faces; plug-in component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
vizall_16 = HBVisualizeAll(hb_objs=flatten(face_10.faces))  # -> geo; plug-in component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
custom_preview_16 = CustomPreview(Geometry=vizall_16, Material=colour_swatch_2)
faces = Merge(
    Data1=face_2.faces,
    Data2=face.faces,
    Data3=face_3.faces,
    Data4=face_4.faces,
    Data5=face_5.faces,
    Data6=face_10.faces,
    Data7=face_6.faces,
    Data8=face_7.faces,
    Data9=face_8.faces,
    Data10=face_9.faces)
data_2 = Data(faces)
clean_3 = CleanTree(RemoveNulls=True, RemoveInvalid=True, RemoveEmpty=True, Tree=data_2)
vizwiref = HBVisualizeWireframe(hb_objs=flatten(clean_3))  # -> geo; plug-in component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
list_length_2 = ListLength(List=flatten(clean_3))

_1_glazings = Panel(layer_names_2)

surface_count_0_solids = Panel(list_length_2)
surface_count_1_glazings = Panel(list_length)

# ----
# Shadings
panel_9 = Panel("2_Shadings::")
revit_geometry_15 = Brep(rir_get_terrain)
revit_geometry_16 = Brep(rir_get_balconies)
brep_16 = Brep(revit_geometry_15)
brep_17 = Brep(revit_geometry_16)
layer_colours_3 = Merge(
    Data1=ColourSwatch(SwatchColor=RGB(88, 159, 214)),
    Data2=ColourSwatch(SwatchColor=RGB(191, 237, 185)),
    Data3=colour_swatch_7,
    Data4=colour_swatch_8)

# ---- group: Rhino
cluster_28 = Cluster_2(A=panel_9, layer="Terrain", reflectance=reflectance_12)  # -> rad_name_2, rhino_layer_name_2
cluster_29 = Cluster_3(lay=cluster_28.rhino_layer_name_2)  # disabled

cluster_30 = Cluster_2(A=panel_9, layer="Balcony", reflectance=reflectance_13)  # -> rad_name_2, rhino_layer_name_2
cluster_31 = Cluster_3(lay=cluster_30.rhino_layer_name_2)  # disabled

cluster_32 = Cluster_2(A=panel_9, layer="Fins", reflectance=reflectance_14)  # -> rad_name_2, rhino_layer_name_2
cluster_33 = Cluster_3(lay=cluster_32.rhino_layer_name_2)  # disabled

cluster_34 = Cluster_2(A=panel_9, layer="Context", reflectance=reflectance_11)  # -> rad_name_2, rhino_layer_name_2
cluster_35 = Cluster_3(lay=cluster_34.rhino_layer_name_2)  # disabled

# ----
rhino_geometry_15 = Brep(cluster_29)
rhino_geometry_16 = Brep(cluster_31)
opaquemod_11 = HBOpaqueModifier(name=cluster_28.rad_name_2, reflect=reflectance_12)  # -> modifier; plug-in component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
opaquemod_12 = HBOpaqueModifier(name=cluster_30.rad_name_2, reflect=reflectance_13)  # -> modifier; plug-in component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
opaquemod_13 = HBOpaqueModifier(name=cluster_32.rad_name_2, reflect=reflectance_14)  # -> modifier; plug-in component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
opaquemod_14 = HBOpaqueModifier(name=cluster_34.rad_name_2, reflect=reflectance_11)  # -> modifier; plug-in component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
face_11 = HBFace(geo=brep_16, name=cluster_28.rad_name_2, rad_mod=opaquemod_11)  # -> out, faces; plug-in component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
face_12 = HBFace(geo=brep_17, name=cluster_30.rad_name_2, rad_mod=opaquemod_12)  # -> out, faces; plug-in component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
face_13 = HBFace(geo=cluster_33, name=cluster_32.rad_name_2, rad_mod=opaquemod_13)  # -> out, faces; plug-in component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
face_14 = HBFace(geo=cluster_35, name=cluster_34.rad_name_2, rad_mod=opaquemod_14)  # -> out, faces; plug-in component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
vizall_17 = HBVisualizeAll(hb_objs=flatten(face_14.faces))  # -> geo; plug-in component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
vizall_18 = HBVisualizeAll(hb_objs=flatten(face_11.faces))  # -> geo; plug-in component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
vizall_19 = HBVisualizeAll(hb_objs=flatten(face_12.faces))  # -> geo; plug-in component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
vizall_20 = HBVisualizeAll(hb_objs=flatten(face_13.faces))  # -> geo; plug-in component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
custom_preview_17 = CustomPreview(Geometry=vizall_17, Material=ColourSwatch(SwatchColor=RGB(61, 61, 61)))
custom_preview_18 = CustomPreview(Geometry=vizall_18, Material=ColourSwatch(SwatchColor=RGB(252, 252, 252)))
custom_preview_19 = CustomPreview(Geometry=vizall_19, Material=colour_swatch_7)
custom_preview_20 = CustomPreview(Geometry=vizall_20, Material=colour_swatch_8)
layer_names_3 = Merge(
    Data1=cluster_34.rhino_layer_name_2,
    Data2=cluster_28.rhino_layer_name_2,
    Data3=cluster_30.rhino_layer_name_2,
    Data4=cluster_32.rhino_layer_name_2)
shading = Merge(Data1=face_14.faces, Data2=face_11.faces, Data3=face_12.faces, Data4=face_13.faces)
data_3 = Data(shading)
clean_4 = CleanTree(RemoveNulls=True, RemoveInvalid=True, RemoveEmpty=True, Tree=data_3)
list_length_3 = ListLength(List=flatten(clean_4))

surface_count_2_shadings = Panel(list_length_3)

model_14 = HBModel(faces=flatten([clean_3, clean_4]), name=project_name)  # -> out, model; disabled; plug-in component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

_2_shading = Panel(layer_names_3)

# ----
# Create sensor grid
brep_edges = BrepEdges(Brep=sensor_planes_included_in_model)  # -> Naked, Interior, NonManifold
convert_to_document_units = ConvertToDocumentUnits(ValueString=perimeter_offset)
join_curves = JoinCurves(Curves=flatten(brep_edges.Naked), Preserve=False)
offset_curve = OffsetCurve(Curve=join_curves, Distance=convert_to_document_units, Corners=1)
boundary_surfaces = BoundarySurfaces(Edges=offset_curve)
convert_to_document_units_2 = ConvertToDocumentUnits(ValueString="50 mm")

# ----
# Max grid size according to EN17037
grid_ds_en_17037 = GRIDDSEN17037(brep=boundary_surfaces)  # -> smallest_grid_size_from_list_2, values_a
boolean = Boolean(grid_ds_en_17037.values_a)
integer = Integer(boolean)
multiplication_2 = Multiplication(A=grid_density, B=integer)
integer_2 = Integer(grid_ds_en_17037.values_a)
expression_2 = Expression(x=integer_2, y=multiplication_2, Expression="Format(\"{0}\", if(x<y,x,y))")  # -> graft(Result)

# ----
# HONEYBEE MODEL
flip_surfaces = FlipSurfaces(brep=boundary_surfaces)

# ----
# INSPECT NORMALS
brep_18 = Brep(flip_surfaces)
debrep_3 = DeconstructBrep(Brep=brep_18)  # -> Faces, Edges, Vertices
evalsrf_3 = EvaluateSurface(Surface=reparameterize(debrep_3.Faces), Point="{0.5,0.5,0}")  # -> Point, Normal, UDirection, VDirection, Frame
amp_2 = Amplitude(Vector=evalsrf_3.Normal, Amplitude=Slider(710, range=0..1000))
vdisex_2 = VectorDisplayEx(Point=evalsrf_3.Point, Vector=amp_2, Colour=RGB(0, 0, 0), Width=2)

adjusted_grid_density_according_to_en170 = Panel(expression_2)  # "Adjusted grid density according to EN17037"

genpts = LBGeneratePointGrid(geometry=flip_surfaces, grid_size=expression_2, quad_only=Toggle(True))  # -> points, vectors, face_areas, graft(mesh); disabled; plug-in component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
dot_display = DotDisplay(Point=genpts.points, Colour=ColourSwatch(SwatchColor=RGB(0, 0, 0)), Size=convert_to_document_units_2)

sensorgrid = HBSensorGrid(name="Zone", positions=genpts.points, directions=genpts.vectors, mesh=genpts.mesh)  # -> grid; plug-in component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

sensor_count = Panel(sensorgrid)

assigngridsviews = HBAssignGridsAndViews(model=model_14.model, grids=flatten(sensorgrid))  # -> model; plug-in component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

hb_model = Data(assigngridsviews)
setup_runs = SetupRuns(
    _model=hb_model,
    _wea=weather_file_2,
    Cpu_count_=50,
    Grid_filter_="*",
    Min_sen_count_=200,
    North_=north_offset,
    Radiance_par_=rad_parameters,
    Schedule=schedule_2,
    Thresholds_="-t 300 -lt 100 -ut 3000",
    Owner="ladybug-tools",
    RecipeJsonString="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",
    project="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")

modeltorad = HBModelToRadFolder(model=assigngridsviews, minimal=Toggle(True), folder=concatenate_2, write=Toggle(True))  # -> out, folder; plug-in component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

# ----
# Run simulation locally through Honeybee
countcpus = CountCpus()  # -> AllCpus, CpusMinusOne, CpusMinusTwo, CpusThirds
# ---------- countcpus: Python ----------
__author__ = "ibc"
__version__ = "2020.11.04"

import rhinoscriptsyntax as rs

import System
count = System.Environment.ProcessorCount

AllCpus = count
CpusMinusOne = count-1
CpusMinusTwo = count -2  
CpusThirds = round(count/3)
# ---------- end countcpus ----------
cpu_count = Data(countcpus.CpusMinusOne)
annualdaylight = HBAnnualDaylight(model=assigngridsviews, wea=wea, schedule=schedule, run=Button())  # -> out, results, DA, cDA, UDI, UDI_low, UDI_up; plug-in component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
simulation_setup = Panel(annualdaylight.out)
simulation_setup_2 = Panel(annualdaylight.DA)

pollinate = Pollinate(
    _runs=flatten(setup_runs),
    _name_=concatenate_3,
    Description_=simulation_log,
    CPUNumber=10,
    IfEnabledRemoteRun=False,
    LiveUpdateStatus=True,
    RunLocal=False)
# Instructions
# 1. Note down changes in the simulation setup in the log.
# 
# 2. Select a new simulation number after each run.
#     This version name will be used for baking the results after the simulation.
# 
# 3. Press the "Pollinate" botton once to log in,
# 
# 4. Press the "Pollinate" botton once more to start the simulation in the cloud.
#     When the run has started, you can follow the simulation time below the
#     "Check Job Status" component
# 
# 5. To cancel the simulation, right-click the "Check Job Status" component
#      and choose "Cancel this job"
# 
# 6. To view the simulation on the cloud, right-click the "Check Job Status"
#     component and choose "Check this job on the Pollination Cloud"
panel_10 = Panel(pollinate)

# ----
# Bake results in Rhino
check_job_status = CheckJobStatus(_job=pollinate, Index_=0, LiveUpdateStatus=True, getBothInputOutputAssets=False)  # -> Status, Run

panel_11 = Panel(check_job_status.Status)

panel_12 = Panel(check_job_status.Run)

# ----
# Visualize results
colour_swatch_11 = ColourSwatch(SwatchColor=RGB(26, 26, 26))
check_run_results = CheckRunResults(
    _run=check_job_status.Run,
    recipeSource="https://api.pollination.cloud/registries/ladybug-tools/recipe/annual-daylight/0.8.20")  # -> CDA, DA, Metrics, Results, UDI, UDI_low, UDI_up
merge = Merge(
    Data1=colour_swatch_11,
    Data2=ColourSwatch(SwatchColor=RGB(56, 56, 56)),
    Data3=ColourSwatch(SwatchColor=RGB(84, 84, 84)),
    Data4=ColourSwatch(SwatchColor=RGB(115, 115, 115)),
    Data5=ColourSwatch(SwatchColor=RGB(145, 145, 145)),
    Data6=ColourSwatch(SwatchColor=RGB(78, 204, 10)),
    Data7=ColourSwatch(SwatchColor=RGB(118, 217, 43)),
    Data8=ColourSwatch(SwatchColor=RGB(160, 227, 77)),
    Data9=ColourSwatch(SwatchColor=RGB(196, 242, 116)),
    Data10=ColourSwatch(SwatchColor=RGB(233, 255, 156)))
load_assets = LoadAssets(Asset_1=check_run_results.DA, LiveUpdateStatus=True, postprocessWithHandler=True, useCachedAssets=True)  # -> Logs, Value_1, Value_2, Value_3
colrange = LBColorRange(index=Slider(0, range=0..25))  # -> colors; plug-in component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
# POST-PROCESSING
flatten_tree = FlattenTree(Tree=load_assets.Value_1, Path="{0}")
legendpar = LBLegendParameters(min="0", max="100", seg_count="11", colors=merge, num_decimals="0")  # -> leg_par; plug-in component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
getgridsviews = HBGetGridsAndViews(model=assigngridsviews)  # -> views, grids, points, meshes; plug-in component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
mesh_join = MeshJoin(Meshes=getgridsviews.meshes)
meshselector = Ladybug_MeshThresholdSelector(inputMesh=mesh_join, analysisResult=flatten(flatten_tree), operator=">=", percentToKeep="100", levelOfPerform="50")  # -> readMe, totalValue, areaMeetsThresh, newColoredMesh, newMeshOutline; plug-in component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
heatmap = LBSpatialHeatmap(
    values=flatten_tree,
    mesh=mesh_join,
    legend_par=legendpar,
    legend_title="sDA [%]",
    global_title="sDA[300lx,50%]according to EN17037")  # -> mesh, legend, title, colors, legend_par; plug-in component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

panel_13 = Panel(meshselector.newMeshOutline)

# ----
# Calculate sDA
unflatten_tree = UnflattenTree(Tree=load_assets.Value_1, Guide=genpts.points)
sda = HBSpatialDaylightAutonomy(DA=unflatten_tree, mesh=getgridsviews.meshes, target_time="50")  # -> out, sDA, pass_fail; plug-in component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
expression_3 = Expression(sDA=sda.sDA, Expression="Format(\"{0:0.00} %\", sDA*100)")
sda_per_room = Panel(expression_3)

element_parameter = ElementParameter(Element=query_elements.Elements, Parameter=stream_filter, Value=sda.sDA)  # -> Element, Value

# ----
# Create layers in Rhino
_3_analysis = Panel("""Sensor
Sensor_Dynamo
Sensor_IkkeAnvendt
Elevation
Section_Horisontal
Section_Vertical""")
_0_solids_2 = Panel(layer_names)
_1_glazings_2 = Panel(layer_names_2)
_2_shading_2 = Panel(layer_names_3)
current_date = CurrentDate()
panel_14 = Panel(current_date)
evaluate = Evaluate(Expression="Format(\"3_Analysis::{0}\", x)", x=_3_analysis)
concatenate_4 = Concatenate(ParentLayer="5_Results::", FragmentB=simulation_version, FragmentA="_", CurrentDate=panel_14)
concatenate_5 = Concatenate(ParentLayer=concatenate_4, FragmentB="::", FragmentA="Visualization")
concatenate_6 = Concatenate(ParentLayer=concatenate_4, FragmentB="::", FragmentA="Simulation log")
concatenate_7 = Concatenate(ParentLayer=concatenate_4, FragmentB="::", FragmentA="50% line")
concatenate_8 = Concatenate(ParentLayer=concatenate_4, FragmentB="::", FragmentA="sDA")
colour_of_layer_in_rhino = Panel(layer_colours_2)
colour_of_layer_in_rhino_2 = Panel(layer_colours_3)
colour_of_layer_in_rhino_3 = Panel(layer_colours)
panel_15 = Panel("""75,107,169
255,0,255
112,175,78
0,0,0
0,0,0
244,176,245""")
define_layer = DefineLayer(Name=_0_solids_2, Color=colour_of_layer_in_rhino_3)
define_layer_2 = DefineLayer(Name=_1_glazings_2, Color=colour_of_layer_in_rhino)
define_layer_3 = DefineLayer(Name=_2_shading_2, Color=colour_of_layer_in_rhino_2)
define_layer_4 = DefineLayer(Name=evaluate, Color=panel_15)
define_layer_5 = DefineLayer(Name=concatenate_5, Color=ColourSwatch(SwatchColor=RGB(0, 0, 0)))
define_layer_6 = DefineLayer(Name=concatenate_6, Color=ColourSwatch(SwatchColor=RGB(0, 0, 0)))
define_layer_7 = DefineLayer(Name=concatenate_7, Color=ColourSwatch(SwatchColor=RGB(0, 0, 0)), LineType="Hidden-1", LineThickness="0.18")
define_layer_8 = DefineLayer(Name=concatenate_8, Color=ColourSwatch(SwatchColor=RGB(0, 0, 0)))
define_layer_9 = DefineLayer(Name="4_RevitLayers")
define_layer_10 = DefineLayer(Name=concatenate_4, Color=ColourSwatch(SwatchColor=RGB(148, 148, 148)))

merge_2 = Merge(Data1=define_layer, Data2=define_layer_2, Data3=define_layer_3, Data4=define_layer_4, Data5=define_layer_9)

bake_modify_layer = BakeModifyLayer(Layer=merge_2, Bake=lb_falsestarttoggle_9)
_3_analysis_2 = Panel(_3_analysis)

merge_3 = Merge(Data1=define_layer_10, Data2=define_layer_7, Data3=define_layer_5, Data4=define_layer_8, Data5=define_layer_6)
bake_results = BakeModifyLayer(Layer=merge_3, Bake=button)

layer_names_4 = Panel(merge_2)

layer_names_5 = Panel(merge_3)

# ----
# Bake results
value_list_2 = ValueList({"Default", "AFRY annotation style"}, selected="Default")
area_3 = Area(Geometry=getgridsviews.meshes)  # -> Area, Centroid
panel_16 = Panel("Simulation log")
panel_17 = Panel(define_layer_5)
panel_18 = Panel("50% line")
panel_19 = Panel("sDA")
U = Units(ValueString="0.005m")
U_2 = Units(ValueString="0.005m")
U_3 = Units(ValueString="0.005m")
U_4 = Units(ValueString="0.005m")
define_object_attributes = DefineObjectAttributes(Name=panel_16, Layer=define_layer_6)
define_object_attributes_2 = DefineObjectAttributes(Name=panel_18, Layer=define_layer_7)
define_object_attributes_3 = DefineObjectAttributes(Name=panel_19, Layer=define_layer_8)
concatenate_9 = Concatenate(FragmentA="Simulation log:", FragmentB=simulation_log)
unit_z = UnitZ(Factor=U)
unit_z_2 = UnitZ(Factor=U_2)
unit_z_3 = UnitZ(Factor=U_3)
unit_z_4 = UnitZ(Factor=U_4)
define_text_object_2 = DefineTextObject(Text=expression_3, Plane=area_3.Centroid, DimensionStyle=value_list_2, OutputType="Text")
move = Move(Geometry=heatmap.mesh, Motion=unit_z_2)  # -> Geometry, Transform
move_2 = Move(Geometry=meshselector.newMeshOutline, Motion=unit_z_3)  # -> Geometry, Transform
move_3 = Move(Geometry=define_text_object_2, Motion=unit_z_4)  # -> Geometry, Transform
define_text_object_3 = DefineTextObject(Text=concatenate_9, Plane="0,0,0", DimensionStyle=value_list_2, OutputType="Text")
move_4 = Move(Geometry=define_text_object_3, Motion=unit_z)  # -> Geometry, Transform
bake_objects_2 = BakeObjects(Geometry=move_2.Geometry, Attributes=define_object_attributes_2, Bake=button)
bake_objects_3 = BakeObjects(Geometry=move_3.Geometry, Attributes=define_object_attributes_3, Bake=button)
bake_objects_4 = BakeObjects(Geometry=move_4.Geometry, Attributes=define_object_attributes, Bake=button)
hatch = LBMeshToHatch(mesh=move.Geometry, layer=panel_17, run=button)  # -> out; plug-in component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

panel_20 = Panel(hatch)

# ----
# Bake results to Revit scene
mesh = Mesh(move.Geometry)  # disabled
ghpython_script = GhPythonScript(x=mesh)  # -> out, a; inputs x: Mesh; disabled
# ---------- ghpython_script: Python ----------
"""Provides a scripting component.
    Inputs:
        x: The x script variable
    Output:
        a: The a output variable"""

__author__ = "chanley"
__version__ = "2019.12.03"

import Rhino as rc

x.Unweld(0, True)
a = x.ExplodeAtUnweldedEdges()
# ---------- end ghpython_script ----------
deconstruct_mesh = DeconstructMesh(Mesh=ghpython_script.a)  # -> Vertices, Faces, Colours, Normals; disabled
average = Average(Input=deconstruct_mesh.Colours)  # disabled
convert_material = ConvertMaterial(Shader=average, TrackingMode=2)  # disabled
panel_21 = Panel("sDA results")  # disabled
panel_22 = Panel(convert_material)  # disabled
add_directshape_curve = AddDirectShapeCurve(Curve=meshselector.newMeshOutline, TrackingMode=2)  # disabled
add_directshape_geometry = AddDirectShapeGeometry(Name=panel_21, Category=query_categories, Geometry=ghpython_script.a, Material=convert_material, TrackingMode=2)  # disabled

panel_23 = Panel(add_directshape_geometry)  # disabled

# ==== cluster CurrentDate
python = PythonScript(x=Toggle(True))  # -> out, Y, M, D, h, m, s
# ---------- python: Python ----------
import datetime
now = datetime.datetime.now()
Y = now.year
M = now.month
D = now.day
h = now.hour
m = now.minute
s = now.second
# ---------- end python ----------
padleft = PadLeft(B=python.M)
padleft_2 = PadLeft(B=python.D)
expression = Expression(Y=python.Y, M=padleft, D=padleft_2, Expression="Format(\"{0}-{1}-{2}\", Y, M, D)")
R = ClusterOutput(expression)

# ==== cluster Schedule
constrheader = LBConstructHeader(data_type="Fraction")  # -> header; plug-in component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
values = ClusterInput()
data = LBConstructData(header=constrheader, values=values)  # -> data; plug-in component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
data_2 = ClusterOutput(data)

# ==== cluster Cluster
layer = ClusterInput()
A = ClusterInput()
transmittance = ClusterInput()
layer_2 = Text(layer)
transmittance_2 = Text(transmittance)

# ----
# Create Rhino layer name
panel = Panel("%")
concatenate = Concatenate(A=A, B=layer_2, C="_", D=transmittance_2, E=panel)
panel_2 = Panel(concatenate)
layer_name = Text(panel_2)

# ----
# Create name for radiance material
concatenate_2 = Concatenate(A=layer_2, B="_", C=transmittance_2, D=panel)
rad_name = Text(concatenate_2)
panel_3 = Panel(concatenate_2)

# ----
# Convert transmittance to decimal number
panel_4 = Panel("100")
division = Division(A=transmittance_2, B=panel_4)

colour_of_layer_in_rhino = ClusterInput()
result = ClusterOutput(division)
colour_of_layer_in_rhino_2 = Colour(colour_of_layer_in_rhino)
rad_name_2 = ClusterOutput(rad_name)
colour_of_layer_in_rhino_3 = ClusterOutput(colour_of_layer_in_rhino_2)
layer_name_2 = ClusterOutput(layer_name)

# ==== cluster ImportApertures
lay = ClusterInput()

# ----
# Import geometry from Rhino and remove extra window panes
panel = Panel("""brep
surface
extrusion
mesh""")
dpipeline = DynamicGeometryPipeline(
    LayerFilter=graft(lay),
    TypeFilter=panel,
    NameFilter="*",
    GroupByLayer=False,
    GroupByType=False,
    IncludeHidden=True,
    IncludeLocked=True,
    enableFullPath=True,
    listenToAttributes=True)
brep = Brep(dpipeline)
deconstruct_brep = DeconstructBrep(Brep=brep)  # -> Faces, Edges, Vertices
area = Area(Geometry=deconstruct_brep.Faces)  # -> Area, Centroid
sort_list = SortList(Keys=area.Area, ValuesValuesA=deconstruct_brep.Faces)  # -> Keys, ValuesValuesA
reverse_list = ReverseList(List=sort_list.ValuesValuesA)
list_item = ListItem(List=reverse_list, Index=0, Wrap=True)
clean = CleanTree(RemoveNulls=True, RemoveInvalid=True, RemoveEmpty=True, Tree=list_item)
geometry = Geometry(clean)

geometry_2 = ClusterOutput(geometry)

# ==== cluster Cluster_2
A = ClusterInput()
layer = ClusterInput()
reflectance = ClusterInput()
layer_2 = Text(layer)
reflectance_2 = Text(reflectance)
concatenate = Concatenate(A=layer_2, B="_", C=reflectance_2)
concatenate_2 = Concatenate(A=A, B=layer_2, C="_", D=reflectance_2)
panel = Panel(concatenate_2)
panel_2 = Panel(concatenate)
rad_name = Text(concatenate)
rhino_layer_name = Text(panel)
rad_name_2 = ClusterOutput(rad_name)
rhino_layer_name_2 = ClusterOutput(rhino_layer_name)

# ==== cluster Cluster_3
panel = Panel("""brep
surface
extrusion
mesh""")
lay = ClusterInput()
dpipeline = DynamicGeometryPipeline(
    LayerFilter=graft(lay),
    TypeFilter=panel,
    NameFilter="*",
    GroupByLayer=False,
    GroupByType=False,
    IncludeHidden=True,
    IncludeLocked=True,
    enableFullPath=True,
    listenToAttributes=True)
clean = CleanTree(RemoveNulls=True, RemoveInvalid=True, RemoveEmpty=True, Tree=dpipeline)
panel_2 = Panel(dpipeline)
geometry = Geometry(clean)
geometry_2 = ClusterOutput(geometry)

# ==== cluster GRIDDSEN17037
brep = ClusterInput()
brep_2 = Brep(brep)
crv = Curve(brep)
null = NullItem(Item=brep_2)  # -> NullFlags, InvalidFlags, Description
boundary = BoundarySurfaces(Edges=crv)
and = GateAnd(A=null.NullFlags, B=null.InvalidFlags)
cull = CullPattern(List=brep_2, CullPattern=invert(and))
cull_2 = CullPattern(List=boundary, CullPattern=and)
brep_3 = Brep([cull_2, cull])
dim = Dimensions(Surface=brep_3)  # -> UDimension, VDimension
max = Maximum(A=dim.UDimension, B=dim.VDimension)
min = Minimum(A=dim.UDimension, B=dim.VDimension)
larger = LargerThan(FirstNumber=max, SecondNumber=Slider(500, range=0..1000))  # -> LargerThan, OrEqualTo
xor = GateXor(A=Toggle(False), B=larger.LargerThan)
units = LBUnitConverter(values=min, from_u="mm", to_u="m")  # -> all_u, values; plug-in component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
units_2 = LBUnitConverter(values=max, from_u="mm", to_u="m")  # -> all_u, values; plug-in component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
ds_en_17037 = Panel("0.2*5^log10(x)")
cull_3 = CullPattern(List=units_2.values, CullPattern=xor)
cull_4 = CullPattern(List=max, CullPattern=invert(xor))
panel = Panel([cull_3, cull_4])
eval = Evaluate(F=ds_en_17037, x=units.values)
python = GhPythonScript(x=eval)  # -> out, a
# ---------- python: Python ----------
__author__ = "ibc"
__version__ = "2020.10.07"

import rhinoscriptsyntax as rs
import math

if x < 1000:
    a="m"
else:
    a="mm"
# ---------- end python ----------
concat = Concatenate(FragmentA=eval, FragmentB=python.a)
clean = CleanTree(RemoveNulls=True, RemoveInvalid=True, RemoveEmpty=True, Tree=panel)
eval_2 = Evaluate(F=ds_en_17037, x=clean)
python_2 = GhPythonScript(x=eval_2)  # -> out, a; same code as python
concat_2 = Concatenate(FragmentA=eval_2, FragmentB=python_2.a)
docunits = ConvertToDocumentUnits(ValueString=concat_2)  # -> flatten(ValueInDocumentUnits)
sort_list = SortList(Keys=docunits, ValuesValuesA=docunits)  # -> Keys, ValuesValuesA
list_item = ListItem(List=sort_list.Keys, Index="0", Wrap=True)
list_of_min_grid_sizes_pr_grid = Panel(sort_list.Keys)
smallest_grid_size_from_list = Panel(list_item)
smallest_grid_size_from_list_2 = ClusterOutput(smallest_grid_size_from_list)

# ---- group: Cluster Output
values_a = ClusterOutput(sort_list.ValuesValuesA)

# ==== cluster FlipSurfaces
brep = ClusterInput()
brep_2 = Brep(brep)
debrep = DeconstructBrep(Brep=brep_2)  # -> Faces, Edges, Vertices
evalsrf = EvaluateSurface(Surface=reparameterize(debrep.Faces), Point="{0.5,0.5,0}")  # -> Point, Normal, UDirection, VDirection, Frame
expression = Expression(x=evalsrf.Normal, Expression="if(x={0,0,-1},True,False)")
expression_2 = Expression(x=evalsrf.Normal, Expression="if(x={0,0,1},True,False)")
cull_pattern = CullPattern(List=brep_2, CullPattern=expression)
cull_pattern_2 = CullPattern(List=brep_2, CullPattern=expression_2)
flip = Flip(Surface=cull_pattern)  # -> Surface, Result
merge = Merge(Data1=flip.Surface, Data2=cull_pattern_2)
result = ClusterOutput(merge)

# ==== cluster RIRGetGeo
C = ClusterInput()
catfltr = CategoryFilter(Categories=C, Inverted=False)
query_elements = QueryElements(Filter=catfltr, Limit="100000000")  # -> Elements, Count
element_geometry = ElementGeometry(Elements=query_elements.Elements)
G = ClusterOutput(element_geometry)

# ==== cluster RIRGetFloors
C = ClusterInput()
catfltr = CategoryFilter(Categories=C, Inverted=False)
query_elements = QueryElements(Filter=catfltr, Limit="100000000")  # -> Elements, Count
element_geometry = ElementGeometry(Elements=query_elements.Elements)
debrep = DeconstructBrep(Brep=element_geometry)  # -> Faces, Edges, Vertices
evalsrf = EvaluateSurface(Surface=reparameterize(debrep.Faces), Point="{0.5,0.5,0}")  # -> Point, Normal, UDirection, VDirection, Frame
expression = Expression(x=evalsrf.Normal, Expression="if(x={0,0,-1},True,False)")
dispatch = Dispatch(List=debrep.Faces, DispatchPattern=expression)  # -> ListA, ListB
list_a = ClusterOutput(dispatch.ListA)
list_b = ClusterOutput(dispatch.ListB)

# ==== cluster RIRGetFrames
C = ClusterInput()
catfltr = CategoryFilter(Categories=C, Inverted=False)
query_elements = QueryElements(Filter=catfltr, Limit="100000000")  # -> Elements, Count
mesh = ClusterInput()
element_geometry = ElementGeometry(Elements=query_elements.Elements)
mesh_2 = Mesh(mesh)
mesh_3 = ClusterOutput(mesh_2)
G = ClusterOutput(element_geometry)

# ==== cluster Cluster_4
wall_system_family = ClusterInput()
query_walls = QueryWalls(WallSystemFamily=wall_system_family)
element_type = ElementType(Element=query_walls)  # -> Element, Type
inspect_element = InspectElement(Element=element_type.Type)
wall_function = WallFunction({"Interior": 0, "Exterior": 1, "Foundation": 2, "Retaining": 3, "Soffit": 4, "Core-Shaft": 5}, selected="Interior")
wall_function_2 = WallFunction({"Interior": 0, "Exterior": 1, "Foundation": 2, "Retaining": 3, "Soffit": 4, "Core-Shaft": 5}, selected="Exterior")
equality = Equality(FirstNumber=inspect_element, SecondNumber=wall_function)  # -> Equality, Inequality
equality_2 = Equality(FirstNumber=inspect_element, SecondNumber=wall_function_2)  # -> Equality, Inequality
cull_pattern = CullPattern(List=element_type.Element, CullPattern=equality.Equality)
cull_pattern_2 = CullPattern(List=element_type.Element, CullPattern=equality_2.Equality)
element_geometry = ElementGeometry(Elements=cull_pattern)
element_geometry_2 = ElementGeometry(Elements=cull_pattern_2, DetailLevel=3)
clean_tree = CleanTree(RemoveNulls=True, RemoveInvalid=True, RemoveEmpty=True, Tree=cull_pattern_2)
deconstruct_brep = DeconstructBrep(Brep=element_geometry_2)  # -> Faces, Edges, Vertices
point = Point(Point(0.5, 0.5, 0))
surface = Surface(deconstruct_brep.Faces)
evaluate_surface = EvaluateSurface(Surface=surface, Point=point)  # -> Point, Normal, UDirection, VDirection, Frame
revit_python = RevitGhPythonTemplate(Wall=clean_tree)  # -> graft(Orientation)
# ---------- revit_python: Python ----------
import clr
clr.AddReference('System.Core')
clr.AddReference('RhinoInside.Revit')
clr.AddReference('RevitAPI') 
clr.AddReference('RevitAPIUI')

from System import Enum

import rhinoscriptsyntax as rs
import Rhino
from Rhino import RhinoMath as RM
import RhinoInside

import Grasshopper
from Grasshopper.Kernel import GH_RuntimeMessageLevel as RML

from RhinoInside.Revit import Revit, Convert

from Autodesk.Revit import DB
from Autodesk.Revit import UI

import RhinoInside.Revit.Convert.Geometry.GeometryEncoder as GE
import RhinoInside.Revit.Convert.Geometry.GeometryDecoder as GD

# active Revit verison
REVIT_VERSION = Revit.ActiveUIApplication.Application.VersionNumber

# access the active document object
doc = Revit.ActiveDBDocument

def show_warning(msg):
    ghenv.Component.AddRuntimeMessage(RML.Warning, msg)

def show_error(msg):
    ghenv.Component.AddRuntimeMessage(RML.Error, msg)

def show_remark(msg):
    ghenv.Component.AddRuntimeMessage(RML.Remark, msg)


def coerce(item):
    if isinstance(item, int):
        return doc.GetElement(DB.ElementId(item))
    elif isinstance(item, DB.Element):
        return item

# IN
# Input param   > description


#OUT
# Output param  > description




if(Wall is not None):
    Orientation = GD.ToVector3d(Wall.Orientation)
# ---------- end revit_python ----------
dot_product = DotProduct(VectorA=evaluate_surface.Normal, VectorB=revit_python, Unitize=False)
equality_3 = Equality(FirstNumber=dot_product, SecondNumber="1")  # -> Equality, Inequality
dispatch = Dispatch(List=surface, DispatchPattern=equality_3.Equality)  # -> ListA, ListB
clean_tree_2 = CleanTree(RemoveNulls=True, RemoveInvalid=True, RemoveEmpty=True, Tree=dispatch.ListB)
clean_tree_3 = CleanTree(RemoveNulls=True, RemoveInvalid=True, RemoveEmpty=True, Tree=dispatch.ListA)
external_wall_exterior_surface = Surface(flatten(clean_tree_3))
external_wall_interior_surface = Surface(flatten(clean_tree_2))
internal_walls = Brep(flatten(element_geometry))
merge = Merge(Data1=internal_walls, Data2=external_wall_interior_surface)
internal_walls_2 = ClusterOutput(merge)
external_wall_exterior_surface_2 = ClusterOutput(external_wall_exterior_surface)

# ==== cluster RIRGetTerrain
C = ClusterInput()
catfltr = CategoryFilter(Categories=C, Inverted=False)
query_elements = QueryElements(Filter=catfltr, Limit=100)  # -> Elements, Count
element_geometry = ElementGeometry(Elements=query_elements.Elements)
filtertype = FilterByType(Geometry=element_geometry, ObjectType="Mesh")  # -> flatten(Geometry)
clean = CleanTree(RemoveNulls=True, RemoveInvalid=True, RemoveEmpty=False, Tree=filtertype)
T = ClusterOutput(clean)

# ==== cluster RIRGetBalconies
family_name = Panel("Altan 3500 x 1600 bred stål altan")
C = ClusterInput()
catfltr = CategoryFilter(Categories=C, Inverted=False)
query_types = QueryTypes(Kind=3, FamilyName=family_name, Filter=catfltr)
type_filter = TypeFilter(Types=query_types, Inverted=False)
logical_and_filter = LogicalAndFilter(FilterA=catfltr, FilterB=type_filter)
query_elements = QueryElements(Filter=logical_and_filter, Limit="100000000")  # -> Elements, Count
element_geometry = ElementGeometry(Elements=query_elements.Elements)
deconstruct_brep = DeconstructBrep(Brep=element_geometry)  # -> Faces, Edges, Vertices
is_planar = IsPlanar(Surface=deconstruct_brep.Faces, Interior=True)  # -> Planar, Plane
boolean = Boolean(invert(is_planar.Planar))
dispatch = Dispatch(List=deconstruct_brep.Faces, DispatchPattern=boolean)  # -> ListA, ListB
brep_join = BrepJoin(Breps=dispatch.ListB)  # -> Breps, Closed
breps = ClusterOutput(brep_join.Breps)

# ==== cluster RIRGetWindow
parameter = ClusterInput()
value = ClusterInput()
windows = ClusterInput()
curtain_panels = ClusterInput()
doors = ClusterInput()

project_parameter = ProjectParameter(Parameter=parameter)  # -> Parameter, Varies, Categories
equals_rule = EqualsRule(Parameter=project_parameter.Parameter, Value=value)
windows_2 = Text(windows)
curtain_panels_2 = Text(curtain_panels)
doors_2 = Text(doors)
parameter_filter = ParameterFilter(Rules=equals_rule, Inverted=False)
logical_and_filter = LogicalAndFilter(FilterA=[windows_2, doors_2], FilterB=parameter_filter)
logical_and_filter_2 = LogicalAndFilter(FilterA=curtain_panels_2, FilterB=parameter_filter)
query_elements = QueryElements(Filter=logical_and_filter, Limit="100000000")  # -> Elements, Count
query_elements_2 = QueryElements(Filter=logical_and_filter_2, Limit="100000000")  # -> Elements, Count
cluster = Cluster_5(element=query_elements.Elements)  # -> frames_2, brep
element_geometry = ElementGeometry(Elements=query_elements_2.Elements)
frames_mesh = Mesh(cluster.frames_2)
glass_breps = Brep(cluster.brep)
curtain_wall = Brep(element_geometry)
glazing = Merge(Data1=glass_breps, Data2=curtain_wall)

frames_mesh_2 = ClusterOutput(frames_mesh)
result = ClusterOutput(glazing)

# ==== cluster PadLeft
B = ClusterInput()
concat = Concatenate(FragmentA="00", FragmentB=B)
len = TextLength(Text=concat)
subtraction = Subtraction(A=len, B=2)
fragment = TextFragment(Text=concat, Start=subtraction)
F = ClusterOutput(fragment)

# ==== cluster Cluster_5
element = ClusterInput()
element_preview = ElementPreview(Element=element, DetailLevel=1)  # -> Meshes, Materials, Wires
expression = Expression(x=element_preview.Materials, Expression="if(x=\"Revit Material : <None>\",TRUE,FALSE)")
expression_2 = Expression(x=element_preview.Materials, Expression="if(x=\"Revit Material : <None>\",FALSE,TRUE)")
dispatch = Dispatch(List=element_preview.Meshes, DispatchPattern=expression)  # -> ListA, ListB
dispatch_2 = Dispatch(List=element_preview.Materials, DispatchPattern=expression_2)  # -> flatten(ListA), ListB
graft_tree = GraftTree(Tree=dispatch_2.ListA, IncludeEmptyLists=True, IncludeNullItems=True)
ghpython_script = GhPythonScript(x=graft_tree)  # -> out, a
# ---------- ghpython_script: Python ----------
__author__ = "mm1013"
__version__ = "2021.12.03"

import clr
clr.AddReference('System.Core')
clr.AddReference('RhinoInside.Revit')
clr.AddReference('RevitAPI') 
clr.AddReference('RevitAPIUI')

from System import Enum

import rhinoscriptsyntax as rs
import Rhino
import RhinoInside
import Grasshopper as GH
from RhinoInside.Revit import Revit
from Autodesk.Revit import DB

# loading extension methods are necessary to access convertor methods
# e.g. Solid.ToBrep()
clr.ImportExtensions(RhinoInside.Revit.Convert.Geometry)

doc = Revit.ActiveDBDocument

import rhinoscriptsyntax as rs

#a = x.Id.IntegerValue

a = doc.GetElement(DB.ElementId(x.Id.IntegerValue)).Transparency
# ---------- end ghpython_script ----------
cull_pattern = CullPattern(List=dispatch.ListB, CullPattern=ghpython_script.a)
cull_pattern_2 = CullPattern(List=element_preview.Meshes, CullPattern=invert(ghpython_script.a))
get_windows = GetWindows(mesh=cull_pattern)
frames = Mesh([cull_pattern_2, dispatch.ListA])
frames_2 = ClusterOutput(frames)
brep = ClusterOutput(get_windows)

# ==== cluster GetWindows
mesh = ClusterInput()
mesh_2 = Mesh(mesh)
disjoint_mesh = DisjointMesh(Mesh=mesh_2)
face_normals = FaceNormals(Mesh=disjoint_mesh)  # -> Centers, simplify(Normals)
list_item = ListItem(List=face_normals.Normals, Index=0, Wrap=True)
mesh_explode = MeshExplode(m=disjoint_mesh)  # -> out, simplify(A)
# ---------- mesh_explode: VB ----------
    Component.Params.Input(0).Name = "Mesh"
    Component.Params.Input(0).Description = "Open or closed mesh"

    Component.Params.Output(1).Name = "Mesh"
    Component.Params.Output(1).Description = "If successful, a valid mesh"

    If m IsNot Nothing Then
      Dim pts As Rhino.Geometry.Collections.MeshVertexList
      Dim faces As Rhino.Geometry.Collections.MeshFaceList
      Dim clrs As Rhino.Geometry.Collections.MeshVertexColorList
      Dim i As Integer
      Dim mshs As New list(Of mesh)

      faces = m.Faces
      pts = m.Vertices
      If m.VertexColors.count() = 0 Then m.VertexColors.CreateMonotoneMesh(color.FromArgb(100, 100, 100))
      clrs = m.VertexColors

      For i = 0 To faces.count() - 1 Step 1
        Dim fc As New meshFace
        Dim face As New MeshFace
        Dim ptList As New list(Of point3d)
        Dim clrList As New list(Of color)
        Dim msh As New mesh

        face = faces(i)

        ptList.add(New point3d(pts(face.A)))
        ptList.add(New point3d(pts(face.B)))
        ptList.add(New point3d(pts(face.C)))
        If face.IsQuad Then ptList.add(New point3d(pts(face.D)))

        clrList.add(clrs(face.A))
        clrList.add(clrs(face.B))
        clrList.add(clrs(face.C))
        If face.IsQuad Then clrList.add(clrs(face.D))

        If face.IsQuad Then fc = New meshFace(0, 1, 2, 3) Else fc = New meshface(0, 1, 2)

        msh.Vertices.AddVertices(ptList.toarray())
        msh.Faces.AddFace(fc)
        msh.VertexColors.SetColors(clrList.toarray())
        mshs.add(msh)
      Next

      A = mshs
    End If
# ---------- end mesh_explode ----------
param_viewer = ParamViewer(list_item)
create_set = CreateSet(List=face_normals.Normals)  # -> Set, Map
data = Data(graft(param_viewer))
unflatten_tree = UnflattenTree(Tree=data, Guide=list_item)
longest_list = LongestList(ListListA=unflatten_tree, ListListB=create_set.Map, PaddingMode=2)  # -> graft(ListListA), graft(ListListB)
deconstruct_path = DeconstructPath(Branch=longest_list.ListListA)  # -> simplify(Indices)
merge = Merge(Data1=deconstruct_path, Data2=longest_list.ListListB)
construct_path = ConstructPath(Indices=merge)
assignpaths = AssignPaths(InputData=flatten(mesh_explode.A), PathsToAssign=flatten(construct_path))
mesh_join = MeshJoin(Meshes=assignpaths)
shift_paths = ShiftPaths(Data=mesh_join, Offset=-1)
area = Area(Geometry=shift_paths)  # -> Area, Centroid
sort_list = SortList(Keys=area.Area, ValuesValuesA=shift_paths)  # -> Keys, reverse(ValuesValuesA)
list_item_2 = ListItem(List=sort_list.ValuesValuesA, Index=0, Wrap=True)  # -> Item, Item1
weld_mesh = WeldMesh(Mesh=list_item_2.Item, Angle=3.141592654)
weld_mesh_2 = WeldMesh(Mesh=list_item_2.Item1, Angle=3.141592654)
quadrangulate = Quadrangulate(Mesh=weld_mesh_2, Angle=0.03490658504, Ratio=0.875)  # -> Mesh, Count
quadrangulate_2 = Quadrangulate(Mesh=weld_mesh, Angle=0.03490658504, Ratio=0.875)  # -> Mesh, Count
face_normals_2 = FaceNormals(Mesh=quadrangulate_2.Mesh)  # -> Centers, Normals
face_normals_3 = FaceNormals(Mesh=quadrangulate.Mesh)  # -> Centers, Normals
distance = Distance(PointA=face_normals_2.Normals, PointB="100,100,100")
distance_2 = Distance(PointA=face_normals_3.Normals, PointB="100,100,100")
larger_than = LargerThan(FirstNumber=distance, SecondNumber=distance_2)  # -> LargerThan, OrEqualTo
cull_pattern = CullPattern(List=quadrangulate_2.Mesh, CullPattern=invert(larger_than.LargerThan))  # -> simplify(List)
cull_pattern_2 = CullPattern(List=quadrangulate.Mesh, CullPattern=larger_than.LargerThan)  # -> simplify(List)
shift_paths_2 = ShiftPaths(Data=[cull_pattern, cull_pattern_2], Offset=-1)
mesh_edges = MeshEdges(Mesh=shift_paths_2)  # -> NakedEdges, InteriorEdges, NonManifoldEdges
join_curves = JoinCurves(Curves=mesh_edges.NakedEdges, Preserve=False)
boundary_surfaces = BoundarySurfaces(Edges=join_curves)  # -> simplify(Surfaces)
abc_a = ABC(data=boundary_surfaces)
c_script = CSharpScript(x=abc_a)  # -> A; inputs x: list of Brep
# ---------- c_script: C# ----------
    if (x.Count > 1)
    {
      Brep b = x[0];
      for (int i = 1; i < x.Count; i++)
      {
			 b.Append(x[i]);
      }
      
      A = b;
    }
    else

    {
      A = x;
    }
# ---------- end c_script ----------
brep = Brep(c_script)
brep_2 = ClusterOutput(brep)

# ==== cluster ABC
data = ClusterInput()
data_2 = Data(data)
path_mapper = PathMapper(
    data_2,
    source=["{A;B;C;D;E;F;G}", "{A;B;C;D;E;F}", "{A;B;C;D;E}", "{A;B;C;D}", "{A;B;C}", "{A;B}", "{A}"],
    target=["{A}", "{A}", "{A}", "{A}", "{A}", "{A}", "{A}"])
data_3 = Data(path_mapper)
data_4 = ClusterOutput(data_3)
