# Grasshopper definition 03_VisualizeResults_Pollination_XX.gh (Grasshopper 1.0.7)
# Copyright: 2017
# plug-ins: PollinationGH, LadybugGrasshopper, EleFront, Human

# ----
# Visualize results
check_job_status = CheckJobStatus(
    _job="labrosse/AFRY_tutorial_project/b942bfd4-fcef-4a33-a3ad-9a8b69f90d94",
    Index_=0,
    getBothInputOutputAssets=False,
    liveUpdateStatus=True)
check_run_inputs = CheckRunInputs(
    _run=check_job_status,
    recipeSource="https://api.pollination.cloud/registries/ladybug-tools/recipe/annual-daylight/0.8.12-viz")  # -> CpuCount, GridFilter, MinSensorCount, Model, North, RadianceParameters, Schedule, Thresholds, Wea
check_run_results = CheckRunResults(
    _run=check_job_status,
    recipeSource="https://api.pollination.cloud/registries/ladybug-tools/recipe/annual-daylight/0.8.12-viz")  # -> CDA, DA, Metrics, Results, Results_direct, UDI, UDI_low, UDI_up, Visualization
load_assets = LoadAssets(
    Folder_="C:\ladybug\Results",
    Asset_1=check_run_results.DA,
    Asset_2=check_run_inputs.Model,
    liveUpdateStatus=True,
    postprocessWithHandler=True,
    useCachedAssets=True)  # -> Logs, Value_1, Value_2, Value_3
merge = Merge(
    Data1=ColourSwatch(SwatchColor=RGB(26, 26, 26)),
    Data2=ColourSwatch(SwatchColor=RGB(56, 56, 56)),
    Data3=ColourSwatch(SwatchColor=RGB(84, 84, 84)),
    Data4=ColourSwatch(SwatchColor=RGB(115, 115, 115)),
    Data5=ColourSwatch(SwatchColor=RGB(145, 145, 145)),
    Data6=ColourSwatch(SwatchColor=RGB(78, 204, 10)),
    Data7=ColourSwatch(SwatchColor=RGB(118, 217, 43)),
    Data8=ColourSwatch(SwatchColor=RGB(160, 227, 77)),
    Data9=ColourSwatch(SwatchColor=RGB(196, 242, 116)),
    Data10=ColourSwatch(SwatchColor=RGB(233, 255, 156)))
lb_falsestarttoggle = LBFalseStartToggle(False)
panel = Panel(load_assets.Value_2)
loadobjects = HBLoadObjects(hb_file=load_assets.Value_2, load=lb_falsestarttoggle)  # -> out, hb_objs; plug-in component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
vizwiref = HBVisualizeWireframe(hb_objs=flatten(loadobjects.hb_objs))  # -> geo; plug-in component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
colrange = LBColorRange(index=Slider(0, range=0..25))  # -> colors; plug-in component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
getgridsviews = HBGetGridsAndViews(model=loadobjects.hb_objs)  # -> views, grids, points, meshes; plug-in component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
colour = Colour(merge)
mesh_join = MeshJoin(Meshes=getgridsviews.meshes)
flatten_tree = FlattenTree(Tree=load_assets.Value_1, Path="{0}")
legendpar = LBLegendParameters(min="10", max="100", seg_count="10", colors=colour, num_decimals="0")  # -> leg_par; plug-in component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
heatmap = LBSpatialHeatmap(
    values=flatten_tree,
    mesh=mesh_join,
    legend_par=legendpar,
    legend_title="sDA[%]",
    global_title="sDA[300lx,50%]according to EN17037")  # -> mesh, legend, title, colors, legend_par; plug-in component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
meshselector = Ladybug_MeshThresholdSelector(inputMesh=mesh_join, analysisResult=flatten(flatten_tree), operator=">=", percentToKeep="100", levelOfPerform="50")  # -> readMe, totalValue, areaMeetsThresh, newColoredMesh, newMeshOutline; plug-in component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

current_date = CurrentDate()
panel_2 = Panel(current_date)
concatenate = Concatenate(ParentLayer="5_Results::", FragmentA="_", CurrentDate=panel_2)
concatenate_2 = Concatenate(ParentLayer=concatenate, FragmentB="::", FragmentA="Visualization")
concatenate_3 = Concatenate(ParentLayer=concatenate, FragmentB="::", FragmentA="50% line")
concatenate_4 = Concatenate(ParentLayer=concatenate, FragmentB="::", FragmentA="sDA")
define_layer = DefineLayer(Name=concatenate_2, Color=ColourSwatch(SwatchColor=RGB(148, 148, 148)))
define_layer_2 = DefineLayer(Name=concatenate_3, Color=ColourSwatch(SwatchColor=RGB(0, 0, 0)))
define_layer_3 = DefineLayer(Name=concatenate_4, Color=ColourSwatch(SwatchColor=RGB(0, 0, 0)))
define_layer_4 = DefineLayer(Name=concatenate, Color=ColourSwatch(SwatchColor=RGB(148, 148, 148)))
merge_2 = Merge(Data1=define_layer_4, Data2=define_layer_2, Data3=define_layer, Data4=define_layer_3)

button = Button()
bake_modify_layer = BakeModifyLayer(Layer=merge_2, Bake=button)

# ----
# Calculate sDA
cluster = Cluster(analysis_mesh=mesh_join, analysis_result=load_assets.Value_1, points=getgridsviews.points, threshold="50")  # -> R, well_lit_per_room_2, conclusion_2, conclusion_pr_floor_2, center_pts_2, crv_2
height_of_text = ValueList({"0.1m", "0.2m", "0.3m", "0.4m", "0.5m", "0.6m", "0.7m", "0.8m", "0.9m", "1.0m"}, selected="0.5m")
value_list = ValueList({"Default", "AFRY annotation style"}, selected="Default")
U = Units(ValueString=height_of_text)
concatenate_5 = Concatenate(FragmentA=cluster.well_lit_per_room_2, FragmentB=" %")
define_text_object = DefineTextObject(Text=concatenate_5, Plane=cluster.center_pts_2, DimensionStyle=value_list, OutputType="Text")
tag = TextTag3D(Location=cluster.center_pts_2, Text=concatenate_5, Size=U, Justification=7)
well_lit_whole_building = Panel(cluster.R)
panel_3 = Panel(cluster.conclusion_pr_floor_2)
panel_4 = Panel(concatenate_5)

# ----
# Bake results
panel_5 = Panel("0.05m")
panel_6 = Panel(define_layer)
U_2 = Units(ValueString="0.05m")
define_object_attributes = DefineObjectAttributes(Name=panel_5, Layer=concatenate_3)
define_object_attributes_2 = DefineObjectAttributes(Name="0.05m", Layer=define_layer_3)
unit_z = UnitZ(Factor=U_2)
move = Move(Geometry=meshselector.newMeshOutline, Motion=unit_z)  # -> Geometry, Transform
bake_objects = BakeObjects(Geometry=move.Geometry, Attributes=define_object_attributes, Bake=button)
bake_objects_2 = BakeObjects(Geometry=define_text_object, Attributes=define_object_attributes_2, Bake=button)
hatch = LBMeshToHatch(layer=panel_6, run=button)  # -> out; plug-in component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

# ==== cluster Cluster
floor = ClusterInput()
analysis_mesh = ClusterInput()
points = ClusterInput()
threshold = ClusterInput()
analysis_result = ClusterInput()
floor_2 = Data(floor)
analysis_mesh_2 = Mesh(analysis_mesh)
points_2 = Data(points)
threshold_2 = Number(threshold)
analysis_result_2 = Data(analysis_result)
mesh_explode = MeshExplode(m=analysis_mesh_2)  # -> out, simplify(A)
# ---------- mesh_explode: VB ----------
    Component.Params.Input(0).Name = "Mesh"
    Component.Params.Input(0).Description = "Open or closed mesh"

    Component.Params.Output(1).Name = "Mesh"
    Component.Params.Output(1).Description = "If successful, a valid mesh"

    If m IsNot Nothing Then
      Dim pts As Rhino.Geometry.Collections.MeshVertexList
      Dim faces As Rhino.Geometry.Collections.MeshFaceList
      Dim clrs As Rhino.Geometry.Collections.MeshVertexColorList
      Dim i As Integer
      Dim mshs As New list(Of mesh)

      faces = m.Faces
      pts = m.Vertices
      If m.VertexColors.count() = 0 Then m.VertexColors.CreateMonotoneMesh(color.FromArgb(100, 100, 100))
      clrs = m.VertexColors

      For i = 0 To faces.count() - 1 Step 1
        Dim fc As New meshFace
        Dim face As New MeshFace
        Dim ptList As New list(Of point3d)
        Dim clrList As New list(Of color)
        Dim msh As New mesh

        face = faces(i)

        ptList.add(New point3d(pts(face.A)))
        ptList.add(New point3d(pts(face.B)))
        ptList.add(New point3d(pts(face.C)))
        If face.IsQuad Then ptList.add(New point3d(pts(face.D)))

        clrList.add(clrs(face.A))
        clrList.add(clrs(face.B))
        clrList.add(clrs(face.C))
        If face.IsQuad Then clrList.add(clrs(face.D))

        If face.IsQuad Then fc = New meshFace(0, 1, 2, 3) Else fc = New meshface(0, 1, 2)

        msh.Vertices.AddVertices(ptList.toarray())
        msh.Faces.AddFace(fc)
        msh.VertexColors.SetColors(clrList.toarray())
        mshs.add(msh)
      Next

      A = mshs
    End If
# ---------- end mesh_explode ----------
unflatten = UnflattenTree(Tree=analysis_result_2, Guide=points_2)
unflatten_2 = UnflattenTree(Tree=mesh_explode.A, Guide=points_2)
larger = LargerThan(FirstNumber=unflatten, SecondNumber=threshold_2)  # -> LargerThan, OrEqualTo
cull = CullPattern(List=unflatten_2, CullPattern=larger.OrEqualTo)
mjoin = MeshJoin(Meshes=cull)
mjoin_2 = MeshJoin(Meshes=unflatten_2)

# ----
# Area which exceeds the target threshold
# Area of each simulation plane
area = Area(Geometry=mjoin)  # -> Area, Centroid
area_2 = Area(Geometry=mjoin_2)  # -> Area, Centroid
nullrep = ReplaceNulls(Items=area.Area, Replacements="0")  # -> Items, Count
expression = Expression(x=nullrep.Items, y=area_2.Area, Expression="Format(\"{0:0}\", x/y*100)")
well_lit_per_room = Integer(expression)

# ----
# Number of compliant zones
larger_2 = LargerThan(FirstNumber=well_lit_per_room, SecondNumber=threshold_2)  # -> LargerThan, OrEqualTo
lng = ListLength(List=flatten(area_2.Area))
ma = MassAddition(Input=flatten(larger_2.OrEqualTo))  # -> Result, PartialResults
expression_2 = Expression(x=ma.Result, y=lng, Expression="Format(\"{0} of {1} zones comply\", x, y)")
conclusion = Text(expression_2)

assign_paths = AssignPaths(InputData=flatten(mjoin_2), PathsToAssign=flatten(floor_2))
U = Units(ValueString=floor_2)
assign_paths_2 = AssignPaths(InputData=flatten(mjoin), PathsToAssign=flatten(floor_2))
cset = CreateSet(List=flatten(U))  # -> Set, Map
mjoin_3 = MeshJoin(Meshes=assign_paths_2)
mjoin_4 = MeshJoin(Meshes=assign_paths)
sort = SortList(Keys=cset.Set)  # -> Keys, ValuesA
area_3 = Area(Geometry=mjoin_3)  # -> Area, Centroid
area_4 = Area(Geometry=mjoin_4)  # -> Area, Centroid
int = Integer(graft(sort.Keys))
U_2 = Units(ValueString=area_3.Area)
U_3 = Units(ValueString=area_4.Area)
nullrep_2 = ReplaceNulls(Items=U_2, Replacements="0")  # -> Items, Count
nullrep_3 = ReplaceNulls(Items=U_3, Replacements="0")  # -> Items, Count
expression_3 = Expression(
    x=nullrep_2.Items,
    y=nullrep_3.Items,
    z=int,
    Expression="Format(\"Zone {2}: {0:0.0} m2 of {1:0.0} m2 area comply\", x, y,z)")  # -> flatten(R)
conclusion_pr_floor = Text(expression_3)
panel = Panel(conclusion_pr_floor)

# ----
# Center of each simulation plane
panel_2 = Panel("0.05m")
U_4 = Units(ValueString=panel_2)
Z = UnitZ(Factor=U_4)
move = Move(Geometry=area_2.Centroid, Motion=Z)  # -> Geometry, Transform
center_pts = Point(move.Geometry)

# ----
# Edges of simulation mesh
medges = MeshEdges(Mesh=mjoin)  # -> NakedEdges, InteriorEdges, NonManifoldEdges
crv = Curve(medges.NakedEdges)

# ----
# Total floor area which exceeds the target threshold
# Total floor area of all simulations surfaces
area_5 = Area(Geometry=mjoin)  # -> Area, Centroid
area_6 = Area(Geometry=mjoin_2)  # -> Area, Centroid
U_5 = Units(ValueString=area_5.Area)
U_6 = Units(ValueString=area_6.Area)
nullrep_4 = ReplaceNulls(Items=U_5, Replacements="0")  # -> Items, Count
ma_2 = MassAddition(Input=flatten(U_6))  # -> Result, PartialResults
ma_3 = MassAddition(Input=flatten(nullrep_4.Items))  # -> Result, PartialResults
expression_4 = Expression(x=ma_3.Result, y=ma_2.Result, Expression="Format(\"{0:0}\", x/y*100)")
well_lit_whole_building = Integer(expression_4)
expression_5 = Expression(x=well_lit_whole_building, Expression="Format(\"{0:0}%\", x)")

# ---- group: Cluster Output
crv_2 = ClusterOutput(crv)

# ----
center_pts_2 = ClusterOutput(center_pts)
well_lit_per_room_2 = ClusterOutput(well_lit_per_room)

# ---- group: Cluster Output
conclusion_2 = ClusterOutput(conclusion)

# ----
R = ClusterOutput(expression_5)
conclusion_pr_floor_2 = ClusterOutput(conclusion_pr_floor)

# ==== cluster CurrentDate
python = PythonScript(x=Toggle(True))  # -> out, Y, M, D, h, m, s
# ---------- python: Python ----------
import datetime
now = datetime.datetime.now()
Y = now.year
M = now.month
D = now.day
h = now.hour
m = now.minute
s = now.second
# ---------- end python ----------
padleft = PadLeft(B=python.M)
padleft_2 = PadLeft(B=python.D)
expression = Expression(Y=python.Y, M=padleft, D=padleft_2, Expression="Format(\"{0}-{1}-{2}\", Y, M, D)")
R = ClusterOutput(expression)

# ==== cluster PadLeft
B = ClusterInput()
concat = Concatenate(FragmentA="00", FragmentB=B)
len = TextLength(Text=concat)
subtraction = Subtraction(A=len, B=2)
fragment = TextFragment(Text=concat, Start=subtraction)
F = ClusterOutput(fragment)
