# Grasshopper definition RIR-import-geometry.gh (Grasshopper 1.0.7)
# plug-ins: Rhino.Inside for Autodesk Revit, EleFront

# ----
# INSPECT NORMALS
brep = Brep()
debrep = DeconstructBrep(Brep=brep)  # -> flatten(Faces), Edges, Vertices
evalsrf = EvaluateSurface(Surface=reparameterize(debrep.Faces), Point="{0.5,0.5,0}")  # -> Point, Normal, UDirection, VDirection, Frame
panel = Panel(evalsrf.Normal)
amp = Amplitude(Vector=evalsrf.Normal, Amplitude=Slider(1000, range=0..1000))
vdisex = VectorDisplayEx(Point=evalsrf.Point, Vector=amp, Colour=RGB(0, 0, 0), Width=2)

reflectance = ValueList({"0.01", "0.02", "0.03", "0.04", "0.05", "0.06", "0.07", "0.08", "0.09", "0.10"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}, selected="0.10")

reflectance_2 = ValueList({"0.01", "0.02", "0.03", "0.04", "0.05", "0.06", "0.07", "0.08", "0.09", "0.10"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}, selected="0.20")

reflectance_3 = ValueList({"0.01", "0.02", "0.03", "0.04", "0.05", "0.06", "0.07", "0.08", "0.09", "0.10"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}, selected="0.20")

reflectance_4 = ValueList({"0.01", "0.02", "0.03", "0.04", "0.05", "0.06", "0.07", "0.08", "0.09", "0.10"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}, selected="0.20")

reflectance_5 = ValueList({"0.01", "0.02", "0.03", "0.04", "0.05", "0.06", "0.07", "0.08", "0.09", "0.10"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}, selected="0.20")

reflectance_6 = ValueList({"0.01", "0.02", "0.03", "0.04", "0.05", "0.06", "0.07", "0.08", "0.09", "0.10"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}, selected="0.50")

reflectance_7 = ValueList({"0.01", "0.02", "0.03", "0.04", "0.05", "0.06", "0.07", "0.08", "0.09", "0.10"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}, selected="0.20")

reflectance_8 = ValueList({"0.01", "0.02", "0.03", "0.04", "0.05", "0.06", "0.07", "0.08", "0.09", "0.10"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}, selected="0.20")

# ----
# Define radiance materials
panel_2 = Panel("Ceiling")
reflectance_9 = ValueList({"0.01", "0.02", "0.03", "0.04", "0.05", "0.06", "0.07", "0.08", "0.09", "0.10"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}, selected="0.70")

reflectance_10 = ValueList({"0.01", "0.02", "0.03", "0.04", "0.05", "0.06", "0.07", "0.08", "0.09", "0.10"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}, selected="0.50")

# ----
# Ground
model = ModelCategoriesPicker({"Abutments": -2006130, "Air Systems": -2001008, "Air Terminals": -2008013, "Analysis Display Style": -2000304, "Analysis Results": -2000303, "Areas": -2003200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}, selected="Topography": -2001340)
catfltr = CategoryFilter(Categories=model, Inverted=False)
query_elements = QueryElements(Filter=catfltr, Limit=100)  # -> Elements, Count
element_geometry = ElementGeometry(Elements=query_elements.Elements)
filtertype = FilterByType(Geometry=element_geometry, ObjectType="Mesh")  # -> flatten(Geometry)
clean = CleanTree(RemoveNulls=True, RemoveInvalid=True, RemoveEmpty=False, Tree=filtertype)

# ----
# Get Room floors
model_2 = ModelCategoriesPicker({"Abutments": -2006130, "Air Systems": -2001008, "Air Terminals": -2008013, "Analysis Display Style": -2000304, "Analysis Results": -2000303, "Areas": -2003200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}, selected="Rooms": -2000160)
catfltr_2 = CategoryFilter(Categories=model_2, Inverted=False)
query_elements_2 = QueryElements(Filter=catfltr_2, Limit=100)  # -> Elements, Count
element_geometry_2 = ElementGeometry(Elements=query_elements_2.Elements)
debrep_2 = DeconstructBrep(Brep=element_geometry_2)  # -> Faces, Edges, Vertices
evalsrf_2 = EvaluateSurface(Surface=reparameterize(debrep_2.Faces), Point="{0.5,0.5,0}")  # -> Point, Normal, UDirection, VDirection, Frame
expression = Expression(x=evalsrf_2.Normal, Expression="if(x={0,0,-1},True,False)")
panel_3 = Panel(evalsrf_2.Normal)
cull_pattern = CullPattern(List=debrep_2.Faces, CullPattern=expression)

# ----
# Doors
model_3 = ModelCategoriesPicker({"Abutments": -2006130, "Air Systems": -2001008, "Air Terminals": -2008013, "Analysis Display Style": -2000304, "Analysis Results": -2000303, "Areas": -2003200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}, selected="Doors": -2000023)
catfltr_3 = CategoryFilter(Categories=model_3, Inverted=False)
query_elements_3 = QueryElements(Filter=catfltr_3, Limit=100)  # -> Elements, Count
inspect_element = InspectElement(Element=query_elements_3.Elements)
boolean = Boolean(invert(inspect_element))
cull_pattern_2 = CullPattern(List=query_elements_3.Elements, CullPattern=boolean)
element_geometry_3 = ElementGeometry(Elements=cull_pattern_2)
filtertype_2 = FilterByType(Geometry=element_geometry_3, ObjectType="Brep")
clean_2 = CleanTree(RemoveNulls=True, RemoveInvalid=True, RemoveEmpty=False, Tree=filtertype_2)

# ----
# Import geometry
# Solids
# Ceiling
model_4 = ModelCategoriesPicker({"Abutments": -2006130, "Air Systems": -2001008, "Air Terminals": -2008013, "Analysis Display Style": -2000304, "Analysis Results": -2000303, "Areas": -2003200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}, selected="Ceilings": -2000038)
catfltr_4 = CategoryFilter(Categories=model_4, Inverted=False)
query_elements_4 = QueryElements(Filter=catfltr_4, Limit=100)  # -> Elements, Count
element_geometry_4 = ElementGeometry(Elements=query_elements_4.Elements)

# ----
# Coloumn
model_5 = ModelCategoriesPicker({"Abutments": -2006130, "Air Systems": -2001008, "Air Terminals": -2008013, "Analysis Display Style": -2000304, "Analysis Results": -2000303, "Areas": -2003200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}, selected="Columns": -2000100)
model_6 = ModelCategoriesPicker({"Abutments": -2006130, "Air Systems": -2001008, "Air Terminals": -2008013, "Analysis Display Style": -2000304, "Analysis Results": -2000303, "Areas": -2003200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}, selected="Structural Columns": -2001330)
catfltr_5 = CategoryFilter(Categories=[model_5, model_6], Inverted=False)
query_elements_5 = QueryElements(Filter=catfltr_5, Limit=100)  # -> Elements, Count
element_geometry_5 = ElementGeometry(Elements=query_elements_5.Elements)

# ----
# Floors
model_7 = ModelCategoriesPicker({"Abutments": -2006130, "Air Systems": -2001008, "Air Terminals": -2008013, "Analysis Display Style": -2000304, "Analysis Results": -2000303, "Areas": -2003200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}, selected="Floors": -2000032)
catfltr_6 = CategoryFilter(Categories=model_7, Inverted=False)
query_elements_6 = QueryElements(Filter=catfltr_6, Limit=100)  # -> Elements, Count
element_geometry_6 = ElementGeometry(Elements=query_elements_6.Elements)

# ----
# Roofs
model_8 = ModelCategoriesPicker({"Abutments": -2006130, "Air Systems": -2001008, "Air Terminals": -2008013, "Analysis Display Style": -2000304, "Analysis Results": -2000303, "Areas": -2003200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}, selected="Roofs": -2000035)
catfltr_7 = CategoryFilter(Categories=model_8, Inverted=False)
query_elements_7 = QueryElements(Filter=catfltr_7, Limit=100)  # -> Elements, Count
element_geometry_7 = ElementGeometry(Elements=query_elements_7.Elements)

# ----
# Stairs
model_9 = ModelCategoriesPicker({"Abutments": -2006130, "Air Systems": -2001008, "Air Terminals": -2008013, "Analysis Display Style": -2000304, "Analysis Results": -2000303, "Areas": -2003200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}, selected="Stairs": -2000120)
catfltr_8 = CategoryFilter(Categories=model_9, Inverted=False)
query_elements_8 = QueryElements(Filter=catfltr_8, Limit=100)  # -> Elements, Count
element_geometry_8 = ElementGeometry(Elements=query_elements_8.Elements)

# ----
# Walls
wall_system_family = WallSystemFamily({"Basic": 0, "Curtain": 1, "Stacked": 2}, selected="Basic")
query_walls = QueryWalls(WallSystemFamily=wall_system_family)
element_type = ElementType(Element=query_walls)  # -> Element, Type
panel_4 = Panel(element_type.Element)
inspect_element_2 = InspectElement(Element=element_type.Type)
wall_function = WallFunction({"Interior": 0, "Exterior": 1, "Foundation": 2, "Retaining": 3, "Soffit": 4, "Core-Shaft": 5}, selected="Exterior")
wall_function_2 = WallFunction({"Interior": 0, "Exterior": 1, "Foundation": 2, "Retaining": 3, "Soffit": 4, "Core-Shaft": 5}, selected="Interior")
equality = Equality(FirstNumber=inspect_element_2, SecondNumber=wall_function_2)  # -> Equality, Inequality
equality_2 = Equality(FirstNumber=inspect_element_2, SecondNumber=wall_function)  # -> Equality, Inequality
cull_pattern_3 = CullPattern(List=element_type.Element, CullPattern=equality.Equality)
cull_pattern_4 = CullPattern(List=element_type.Element, CullPattern=equality_2.Equality)
element_geometry_9 = ElementGeometry(Elements=cull_pattern_3)
element_geometry_10 = ElementGeometry(Elements=cull_pattern_4, DetailLevel=3)
clean_tree = CleanTree(RemoveNulls=True, RemoveInvalid=True, RemoveEmpty=True, Tree=cull_pattern_4)
deconstruct_brep = DeconstructBrep(Brep=element_geometry_10)  # -> Faces, Edges, Vertices
point = Point(Point(0.5, 0.5, 0))
surface = Surface(deconstruct_brep.Faces)
evaluate_surface = EvaluateSurface(Surface=surface, Point=point)  # -> Point, Normal, UDirection, VDirection, Frame
revit_python = RevitGhPythonTemplate(Wall=clean_tree)  # -> graft(Orientation)
# ---------- revit_python: Python ----------
import clr
clr.AddReference('System.Core')
clr.AddReference('RhinoInside.Revit')
clr.AddReference('RevitAPI') 
clr.AddReference('RevitAPIUI')

from System import Enum

import rhinoscriptsyntax as rs
import Rhino
from Rhino import RhinoMath as RM
import RhinoInside

import Grasshopper
from Grasshopper.Kernel import GH_RuntimeMessageLevel as RML

from RhinoInside.Revit import Revit, Convert

from Autodesk.Revit import DB
from Autodesk.Revit import UI

import RhinoInside.Revit.Convert.Geometry.GeometryEncoder as GE
import RhinoInside.Revit.Convert.Geometry.GeometryDecoder as GD

# active Revit verison
REVIT_VERSION = Revit.ActiveUIApplication.Application.VersionNumber

# access the active document object
doc = Revit.ActiveDBDocument

def show_warning(msg):
    ghenv.Component.AddRuntimeMessage(RML.Warning, msg)

def show_error(msg):
    ghenv.Component.AddRuntimeMessage(RML.Error, msg)

def show_remark(msg):
    ghenv.Component.AddRuntimeMessage(RML.Remark, msg)


def coerce(item):
    if isinstance(item, int):
        return doc.GetElement(DB.ElementId(item))
    elif isinstance(item, DB.Element):
        return item

# IN
# Input param   > description


#OUT
# Output param  > description




if(Wall is not None):
    Orientation = GD.ToVector3d(Wall.Orientation)
# ---------- end revit_python ----------
dot_product = DotProduct(VectorA=evaluate_surface.Normal, VectorB=revit_python, Unitize=False)
equality_3 = Equality(FirstNumber=dot_product, SecondNumber="1")  # -> Equality, Inequality
dispatch = Dispatch(List=surface, DispatchPattern=equality_3.Equality)  # -> ListA, ListB
internal_walls = Brep(flatten(element_geometry_9))
external_wall_exterior_surface = Surface(flatten(dispatch.ListA))
external_wall_interior_surface = Surface(flatten(dispatch.ListB))
interior_side = Merge(Data1=external_wall_interior_surface, Data2=internal_walls, Data3=element_geometry_9)  # -> flatten(Result)
wall_ext = CleanTree(RemoveNulls=True, RemoveInvalid=True, RemoveEmpty=True, Tree=external_wall_exterior_surface)
wall_int = CleanTree(RemoveNulls=True, RemoveInvalid=True, RemoveEmpty=True, Tree=interior_side)

opaquemod = HBOpaqueModifier(reflect=reflectance)  # -> modifier; plug-in component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
mesh = Mesh(clean)
face = HBFace(geo=mesh, name="Terrain", rad_mod=opaquemod)  # -> out, faces; plug-in component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
custom_preview = CustomPreview(Geometry=mesh, Material=ColourSwatch(SwatchColor=RGB(191, 237, 185)))

light_transmittance = ValueList({"0.99", "0.98", "0.97", "0.96", "0.95", "0.94", "0.93", "0.92", "0.91", "0.90"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}, selected="0.64")

light_transmittance_2 = ValueList({"0.99", "0.98", "0.97", "0.96", "0.95", "0.94", "0.93", "0.92", "0.91", "0.90"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}, selected="0.74")

light_transmittance_3 = ValueList({"0.99", "0.98", "0.97", "0.96", "0.95", "0.94", "0.93", "0.92", "0.91", "0.90"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}, selected="0.77")

light_transmittance_4 = ValueList({"0.99", "0.98", "0.97", "0.96", "0.95", "0.94", "0.93", "0.92", "0.91", "0.90"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}, selected="0.41")

light_transmittance_5 = ValueList({"0.99", "0.98", "0.97", "0.96", "0.95", "0.94", "0.93", "0.92", "0.91", "0.90"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}, selected="0.82")

# ----
# Glazings
model_10 = ModelCategoriesPicker({"Abutments": -2006130, "Air Systems": -2001008, "Air Terminals": -2008013, "Analysis Display Style": -2000304, "Analysis Results": -2000303, "Areas": -2003200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}, selected="Curtain Panels": -2000170)
model_11 = ModelCategoriesPicker({"Abutments": -2006130, "Air Systems": -2001008, "Air Terminals": -2008013, "Analysis Display Style": -2000304, "Analysis Results": -2000303, "Areas": -2003200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}, selected="Windows": -2000014)
catfltr_9 = CategoryFilter(Categories=model_11, Inverted=False)
catfltr_10 = CategoryFilter(Categories=model_10, Inverted=False)
query_elements_9 = QueryElements(Filter=catfltr_10, Limit="100000000")  # -> Elements, Count
query_elements_10 = QueryElements(Filter=catfltr_9, Limit=100)  # -> Elements, Count
element_geometry_11 = ElementGeometry(Elements=query_elements_9.Elements)
element_geometry_12 = ElementGeometry(Elements=query_elements_10.Elements)
list_item = ListItem(List=element_geometry_12, Index=Slider(0, range=0..10), Wrap=True)
deconstruct_brep_2 = DeconstructBrep(Brep=list_item)  # -> Faces, Edges, Vertices
sort_list = SortList(Keys=deconstruct_brep_2.Faces, ValuesValuesA=deconstruct_brep_2.Faces)  # -> Keys, reverse(ValuesValuesA)
list_item_2 = ListItem(List=sort_list.ValuesValuesA, Index=0, Wrap=True)
brep_2 = Brep(list_item_2)

# ----
# Frames
model_12 = ModelCategoriesPicker({"Abutments": -2006130, "Air Systems": -2001008, "Air Terminals": -2008013, "Analysis Display Style": -2000304, "Analysis Results": -2000303, "Areas": -2003200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}, selected="Curtain Wall Mullions": -2000171)
cull_i = CullIndex(List=element_geometry_12, Indices=Slider(0, range=0..10), Wrap=True)  # -> simplify(List)
catfltr_11 = CategoryFilter(Categories=model_12, Inverted=False)
query_elements_11 = QueryElements(Filter=catfltr_11, Limit="100000000")  # -> Elements, Count
element_geometry_13 = ElementGeometry(Elements=query_elements_11.Elements)
brep_3 = Brep(cull_i)
merge = Merge(Data1=element_geometry_13, Data2=brep_3)

# ----
# Solids
opaquemod_2 = HBOpaqueModifier(reflect=reflectance_8)  # -> modifier; plug-in component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
opaquemod_3 = HBOpaqueModifier(reflect=reflectance_2)  # -> modifier; plug-in component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
opaquemod_4 = HBOpaqueModifier(reflect=reflectance_3)  # -> modifier; plug-in component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
opaquemod_5 = HBOpaqueModifier(reflect=reflectance_9)  # -> modifier; plug-in component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
opaquemod_6 = HBOpaqueModifier(reflect=reflectance_10)  # -> modifier; plug-in component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
opaquemod_7 = HBOpaqueModifier(reflect=reflectance_5)  # -> modifier; plug-in component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
opaquemod_8 = HBOpaqueModifier(reflect=reflectance_6)  # -> modifier; plug-in component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
opaquemod_9 = HBOpaqueModifier(reflect=reflectance_7)  # -> modifier; plug-in component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
opaquemod_10 = HBOpaqueModifier(reflect=reflectance_4)  # -> modifier; plug-in component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
brep_4 = Brep(wall_ext)
brep_5 = Brep(element_geometry_6)
brep_6 = Brep(merge)
brep_7 = Brep(clean_2)
brep_8 = Brep(element_geometry_5)
brep_9 = Brep(element_geometry_4)
brep_10 = Brep(element_geometry_8)
brep_11 = Brep(wall_int)
brep_12 = Brep(element_geometry_7)
face_2 = HBFace(geo=brep_7, name="Door", rad_mod=opaquemod_2)  # -> out, faces; plug-in component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
face_3 = HBFace(geo=brep_5, name="Floor", rad_mod=opaquemod_3)  # -> out, faces; plug-in component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
face_4 = HBFace(geo=brep_6, name="Frames", rad_mod=opaquemod_4)  # -> out, faces; plug-in component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
face_5 = HBFace(geo=brep_9, name=panel_2, rad_mod=opaquemod_5)  # -> out, faces; plug-in component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
face_6 = HBFace(geo=brep_8, name="Column", rad_mod=opaquemod_6)  # -> out, faces; plug-in component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
face_7 = HBFace(geo=brep_10, name="Stairs", rad_mod=opaquemod_7)  # -> out, faces; plug-in component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
face_8 = HBFace(geo=brep_11, name="Wall_Int", rad_mod=opaquemod_8)  # -> out, faces; plug-in component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
face_9 = HBFace(geo=brep_4, name="Wall_Ext", rad_mod=opaquemod_9)  # -> out, faces; plug-in component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
face_10 = HBFace(geo=brep_12, name="Roof", rad_mod=opaquemod_10)  # -> out, faces; plug-in component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
custom_preview_2 = CustomPreview(Geometry=brep_7, Material=ColourSwatch(SwatchColor=RGB(120, 98, 98)))
custom_preview_3 = CustomPreview(Geometry=brep_5, Material=ColourSwatch(SwatchColor=RGB(255, 255, 255)))
custom_preview_4 = CustomPreview(Geometry=brep_6, Material=ColourSwatch(SwatchColor=RGB(120, 80, 80)))
custom_preview_5 = CustomPreview(Geometry=brep_9, Material=ColourSwatch(SwatchColor=RGB(240, 230, 228)))
custom_preview_6 = CustomPreview(Geometry=brep_8, Material=ColourSwatch(SwatchColor=RGB(235, 45, 252)))
custom_preview_7 = CustomPreview(Geometry=brep_10, Material=ColourSwatch(SwatchColor=RGB(252, 45, 45)))
custom_preview_8 = CustomPreview(Geometry=brep_11, Material=ColourSwatch(SwatchColor=RGB(156, 156, 156)))
custom_preview_9 = CustomPreview(Geometry=brep_4, Material=ColourSwatch(SwatchColor=RGB(250, 141, 7)))
custom_preview_10 = CustomPreview(Geometry=brep_12, Material=ColourSwatch(SwatchColor=RGB(153, 83, 245)))
solid_materials = Merge(
    Data1=face_5.faces,
    Data2=face_6.faces,
    Data3=face_2.faces,
    Data4=face_3.faces,
    Data5=face_4.faces,
    Data6=face_10.faces,
    Data7=face_7.faces,
    Data8=face_8.faces,
    Data9=face_9.faces,
    Data10=face.faces)
clean_3 = CleanTree(RemoveNulls=True, RemoveInvalid=True, RemoveEmpty=True, Tree=solid_materials)

# ----
# Glazings
light_transmittance_6 = ValueList({"0.99", "0.98", "0.97", "0.96", "0.95", "0.94", "0.93", "0.92", "0.91", "0.90"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}, selected="0.71")
glassmod = HBGlassModifier(trans=light_transmittance)  # -> modifier; plug-in component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
glassmod_2 = HBGlassModifier(trans=light_transmittance_5)  # -> modifier; plug-in component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
glassmod_3 = HBGlassModifier(trans=light_transmittance_4)  # -> modifier; plug-in component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
glassmod_4 = HBGlassModifier(trans=light_transmittance_6)  # -> modifier; plug-in component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
glassmod_5 = HBGlassModifier(trans=light_transmittance_2)  # -> modifier; plug-in component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
glassmod_6 = HBGlassModifier(trans=light_transmittance_3)  # -> modifier; plug-in component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
brep_13 = Brep(brep_2)
brep_14 = Brep()
brep_15 = Brep()
brep_16 = Brep()
brep_17 = Brep(element_geometry_11)
brep_18 = Brep()
aperture = HBAperture(geo=brep_13, name="Glass", rad_mod=glassmod)  # -> out, apertures; plug-in component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
aperture_2 = HBAperture(geo=brep_14, name="Glass_Int", rad_mod=glassmod_2)  # -> out, apertures; plug-in component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
aperture_3 = HBAperture(geo=brep_16, name="OvenlysKuppel", rad_mod=glassmod_3)  # -> out, apertures; plug-in component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
aperture_4 = HBAperture(geo=brep_15, name="OvenlysFlad", rad_mod=glassmod_4)  # -> out, apertures; plug-in component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
aperture_5 = HBAperture(geo=brep_17, name="Glass", rad_mod=glassmod_5)  # -> out, apertures; plug-in component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
aperture_6 = HBAperture(geo=brep_18, name="Glass", rad_mod=glassmod_6)  # -> out, apertures; plug-in component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
custom_preview_11 = CustomPreview(Geometry=brep_13, Material=ColourSwatch(SwatchColor=RGBA(0, 81, 255, 100)))
custom_preview_12 = CustomPreview(Geometry=brep_14, Material=ColourSwatch(SwatchColor=RGBA(179, 0, 255, 100)))
custom_preview_13 = CustomPreview(Geometry=brep_16, Material=ColourSwatch(SwatchColor=RGBA(0, 115, 255, 100)))
custom_preview_14 = CustomPreview(Geometry=brep_15, Material=ColourSwatch(SwatchColor=RGBA(0, 115, 255, 100)))
custom_preview_15 = CustomPreview(Geometry=brep_17, Material=ColourSwatch(SwatchColor=RGBA(112, 255, 255, 100)))
custom_preview_16 = CustomPreview(Geometry=brep_18, Material=ColourSwatch(SwatchColor=RGBA(132, 255, 94, 100)))
glazings = Merge(
    Data1=aperture.apertures,
    Data2=aperture_5.apertures,
    Data3=aperture_6.apertures,
    Data4=aperture_2.apertures,
    Data5=aperture_4.apertures,
    Data6=aperture_3.apertures)
clean_4 = CleanTree(RemoveNulls=True, RemoveInvalid=True, RemoveEmpty=True, Tree=glazings)
